vi "Main.gvi"   [LabVIEW NXG 5.0.0]
# This template is for the Queued Message Handler design pattern. The Event Handling Loop generates messages based on user interface actions. The Message Handling Loop processes messages generated by the Event Handling Loop, or by other messages. The messages are string values, so new messages can be added easily to the Message Cases case structure in the Message Handling Loop. Each message cluster can also provide an optional value for Message Data, which is a variant that can be converted to whatever message-specific data is required.
panel controls:
  "Exit": bool
  "TEMP Button": bool
  "LUX Button": bool
  "VISA Resource Name": "VISA Instr" = "COM5"
  "Initialize VISA": bool
  "CMD Button": bool
  "Initialize AI": bool
  "Panel Config Button": bool
  "Set PV Angle Button": bool
  "IR Thermometer Position": bool
  "Fans Button": bool
  "Brightness Config Button": bool
  "Optic Filter Config Button": bool
  "Reset CVM Button": bool
  "Stop": bool
  "Panel Config Selector": string
  "PV Angle": i32
  "Fans Selector": string
  "Optic Filter Selector": string
  "IR Thermometer Position Selector": string
  "Brightness": i32
  "Prepare CVM": bool
  "Command to Arduino": string = "@DO 34 0#"
  "Set LoadR": bool
  "No Load": bool
  "Set LoadRTotal": string
  "VAC Button": bool
  "Heat Selector": string
  "Heat Button": bool
  "Exit 2": bool
  "Do Something": bool
  "Do Something Else": bool
  "Tab": i32
  "LoadR1": string
  "LoadR10": string
  "LoadR100": string
  "LoadR1000": string
  "Measured Data": "Measured Data.gtype"
  "Receive MV": bool
panel indicators:
  "Display": string
  "Command reply": "ArduinoReply.gtype"
  "LUXSensor Reply": "ArduinoReply.gtype"
  "TempSensor Reply": "ArduinoReply.gtype"
  "AI measurements": waveform<f64>[]
  "Hardware Current Status": string
  "V Coeff": f64
  "C Coeff": f64
  "Recalculated Voltage": f64
  "Recalculated Current": f64
  "VAC Load Counter": i32
  "Voltage_Graph": f64[]
  "VISA Answer_2": "ArduinoReply.gtype"[]
  "Current_Graph": f64[]
  "VAC": cluster{"Element 1": f64[], "Element 2": f64[]}
  "PV-Connecting Solar Panels": string
  "MV-Panel Configuration": string
  "MV-Cooling": string
  "MV-Heating": string
  "MV-Optical Filter": string
  "MV-Panel Tilt Angle": string
  "MV-Light Power": string
  "MV-LoadR1": string
  "MV-LoadR2": string
  "MV-LoadR3": string
  "MV-LoadR4": string
  "API Key": string
  "Server URL": string
  "Status of Send to SystemLink Cycle": string
  "PV-Current, mA": f64
  "SendDoubleToCloud": string
  "PV-LoadR,Ohm": f64
  "PV-Voltage, V": f64
  "PV-Temperature, ºC": f64
  "PV-LightIntensity, W/m2": f64
  "PV-Panel Tilt Angle, º": f64
  "PV-Panel Cofiguration": string
  "SendStringToCloud": string
  "PV-Cooling": string
  "PV-Heating": string
  "PV-Optical Filter": string
  "PV-LoadR1": string
  "PV-LoadR2": string
  "PV-LoadR3": string
  "PV-LoadR4": string
  "Error out Systemlink Read Cycle": error
  "Voltage MidPoint": f64
  "Current MidPoint": f64
  "Arduino Status": string
  "SendArrayDoubleToCloud": string
  "TempSensor": f64
  "LuxSensor": f64
  "LuxSensor Error": string
  "Total Set LoadR": i32
  "TempSensor Error": string
  "MV-LoadRTotal": string
  "Voltage EndPoint": f64
  "Current EndPoint": f64
  "TempSensor IR": f64
  "PV-LoadRTotal": string
  "PV-Temperature IR Position": string
  "PV-LigthPower, %": f64
  "PV-Temperature IR, ºC": f64
  "Total LoadR_SET": string
types:
  "ArduinoReply.gtype" = cluster{"Timestamp": timestamp, "DATA": string}
  "Measured Data.gtype" = cluster{"Voltage, V": f64, "Current, mA": f64, "Luminous Flux, Lux": f64, "Temperature, GradC": f64, "Temperature IR, GradC": f64}
  T1 = cluster{"VISA Resource": "VISA Instr", "Physical Channel": "DAQmx Task"}
  "UI Data.gtype" = cluster{"Boolean": bool, "String": string, "Numeric": f64}
  "ValueRange.gtype" = cluster{"maximum value": f64, "minimum value": f64}
uses:
  NI::Skyline::Configuration::Open Configuration API Key.gvi
  NI::Skyline::TagHTTP::Query Tags.gvi
  NI::Skyline::TagHTTP::Open Tag.gvi
  NI::Skyline::TagHTTP::Read Tag (String).gvi
  NI::Skyline::TagHTTP::Close Tag (Single).gvi
  NI::Skyline::Configuration::Close Configuration.gvi
  Message Queue::Create All Message Queues.gvi
  Message Queue::Enqueue Message (Single).gvi
  Support::Error Handler - Event Handling Loop.gvi
  Message Queue::Dequeue Message.gvi
  NI::VISA::Configure Serial Port (Instr).gvi
  NI::VISA::Open (Instr).gvi
  NI::DAQmx::Internal::DAQmx Create Channel (AI-Voltage-Basic).gvi
  Queued Message Handler::VISA ReadWrite.gvi
  Queued Message Handler::VISA Reply Parse.gvi
  NI::DAQmx::Internal::DAQmx Read (Analog 2D DBL NChan NSamp).gvi
  NI::DAQmx::Internal::DAQmx Read (Analog 1D Wfm NChan NSamp).gvi
  Queued Message Handler::Panel Switch.gvi
  Queued Message Handler::VISA Multiple Write.gvi
  NI::G Core::Error::Display Error.gvi
  NI::DAQmx::Internal::DAQmx Stop Task.gvi
  NI::VISA::Close (Instr).gvi
  NI::G Core::Error::Build Error Cluster.gvi
  Support::Error Handler - Message Handling Loop.gvi
  NI::Skyline::TagHTTP::Write Tag (DBL).gvi
  NI::Skyline::TagHTTP::Write Tag (String).gvi
  NI::Vision::IMAQdx::Initialize.gvi
  NI::Vision::IMAQdx::Configure Grab.gvi
  NI::Vision::Core::Basics::Create Image.gvi
  NI::Vision::IMAQdx::Grab.gvi
  NI::Vision::IMAQdx::Close.gvi
diagram:
  $"MV-Panel Configuration" <- ""
  $"MV-Cooling" <- ""
  $"MV-Heating" <- ""
  $"MV-Optical Filter" <- ""
  $"MV-Panel Tilt Angle" <- ""
  $"MV-Light Power" <- ""
  $"MV-LoadR1" <- ""
  $"MV-LoadR2" <- ""
  $"MV-LoadR3" <- ""
  $"MV-LoadR4" <- ""
  $"MV-LoadRTotal" <- ""
  # PV Config
  # 	Single
  # 	Parallel 2
  # 	Parallel 2 Diode
  # 	Series 2
  # 	Series 2 Diode
  # 	Parallel 4
  # 	Parallel 4 Diode
  # 	Series 4
  # 	Series 4 Diode
  # 	Parallel Of Series
  # 	Parallel Of Series Diode
  # 	Series Of Parallel
  # 	Series Of Parallel Diode
  # Optic Filter Config
  # 	No Filter
  # 	Filter 1
  # 	Filter 2
  # IR Thermomether
  # 	None
  # 	Panel 1
  # 	Panel 2
  # 	Panel 3
  # 	Panel 4
  # Heating/Cooling
  # 	0
  # 	50
  # 	100
  # Light Power
  # 	0 ... 100
  # Panel Tilt Angle
  # 	0 ... 120
  # Load 1
  # 	1,2,3,5;
  # Load 2
  # 	10,20.40,50;
  # Load 3
  # 	100,200,400,500;
  # Load 4
  # 	1000,2000,4000;
  w1 = ["MV-Panels Configuration", "MV-Cooling", "MV-Heating", "MV-Optical Filter", "MV-Panel Tilt Angle", "MV-Light Power", "MV-LoadR1", "MV-LoadR2", "MV-LoadR3", "MV-LoadR4", "MV-LoadRTotal"]
  Array Size(array=w1) -> (size(s)=w2)
  Initialize Array(element=1904-12-31T23:00:00Z, size=w2) -> w3
  sequence {
    frame 0 {
      Wait(time to wait=20000)
    }
  }
  s1 = w3  # shift register
  while {
    Wait(time to wait=500)
    case ($"Receive MV") {
      frame False, Default {
        w4 = s1
      }
      frame True {
        call "Open Configuration API Key.gvi"(server url=$"Server URL", api key=$"API Key") -> (configuration=w5, error out=w6)
        call "Query Tags.gvi"(paths=w1, error in=w6, configuration=w5) -> (tags=w7, error out=w8)
        Build Array(reference to "MV-Panel Configuration", reference to "MV-Cooling", reference to "MV-Heating", reference to "MV-Optical Filter", reference to "MV-Panel Tilt Angle", reference to "MV-Light Power", reference to "MV-LoadR1", reference to "MV-LoadR2", reference to "MV-LoadR3", reference to "MV-LoadR4", reference to "MV-LoadRTotal") -> w9
        for {
          w10 = each element of w7
          w11 = each element of s1
          w12 = each element of w9
          Property Node(instance in=w10) -> ("Path"=w13, "Datatype"=w14)
          call "Open Tag.gvi"(path=w13, data type=w14, error in=w8, configuration=w5) -> (tag=w15, error out=w16)
          call "Read Tag (String).gvi"(tag in=w15, error in=w16) -> (value=w17, time stamp=w18, error out=w19)
          Is Greater(x=w18, y=w11) -> w20
          case (w20) {
            frame False, Default { }
            frame True {
              Property Node(instance in=w12, "ValueSignaling"=w17)
            }
          }
          append w18 to w4
        }
        for {
          w21 = each element of w7
          call "Close Tag (Single).gvi"(tag=w21, error in=w19) -> (error out=w22)
        }
        call "Close Configuration.gvi"(configuration=w5, error in=w22) -> (error out=w23)
        $"Error out Systemlink Read Cycle" <- w23
      }
    }
    next s1 = w4
    stop if $"Exit 2"
  }
  $"PV-Connecting Solar Panels" <- ""
  disable {
    frame Enabled { }
    frame Disabled {
      Destroy User Event()
    }
  }
  w24 = bool FALSE  # Stop Event
  Create User Event[EventName="Stop Event"](user event data type=w24) -> (error out=w25, user event out=w26)
  Register For Events("Stop Event"=w26) -> (event registration refnum out=w27)
  call "Create All Message Queues.gvi"(error in=w25) -> (message queues=w28, error out=w29)
  Property Node(instance in=w28) -> ("UI"=w30)
  s2 = w27  # shift register
  while {
    event (dynamic events = s2) {
      on "Exit" Value changed {
        call "Enqueue Message (Single).gvi"(priority message=TRUE, message queue in=w30, message="Exit") -> (message queue out=w33, error out=w32)
        w31 = default
      }
      on dynamic event 0 {
        $Display <- "\"Exit\" button pressed"
        w31 = TRUE
        w32 = default
        w33 = w30
      }
      on "Window" Close? {
        call "Enqueue Message (Single).gvi"(priority message=TRUE, message queue in=w30, message="Exit") -> (message queue out=w33)
        Event Filter("Discard?"=TRUE)
        w31 = default
        w32 = default
      }
      on "Initialize VISA" Value changed {
        call "Enqueue Message (Single).gvi"(message queue in=w30, message="Initialize VISA") -> (message queue out=w33, error out=w32)
        w31 = default
      }
      on "Initialize AI" Value changed {
        call "Enqueue Message (Single).gvi"(message queue in=w30, message="Initialize AI") -> (message queue out=w33, error out=w32)
        w31 = default
      }
      on "CMD Button" Value changed {
        call "Enqueue Message (Single).gvi"(message queue in=w30, message="Send CMD") -> (message queue out=w33, error out=w32)
        w31 = default
      }
      on "TEMP Button" Value changed {
        call "Enqueue Message (Single).gvi"(message queue in=w30, message="Get Temperature") -> (message queue out=w33, error out=w32)
        w31 = default
      }
      on "LUX Button" Value changed {
        call "Enqueue Message (Single).gvi"(message queue in=w30, message="Get Brightness") -> (message queue out=w33, error out=w32)
        w31 = default
      }
      on "Reset CVM Button" Value changed {
        call "Enqueue Message (Single).gvi"(message queue in=w30, message="Reset CVM") -> (message queue out=w33, error out=w32)
        w31 = default
      }
      on "Panel Config Button" Value changed {
        call "Enqueue Message (Single).gvi"(message queue in=w30, message="Reset CVM") -> (message queue out=w34, error out=w35)
        call "Enqueue Message (Single).gvi"(message queue in=w34, message="Panel Config", message data=$"Panel Config Selector", error in=w35) -> (message queue out=w33, error out=w32)
        w31 = default
      }
      on "MV-Panel Configuration" Value changed {
        Event Data() -> ("New Value"=w36)
        call "Enqueue Message (Single).gvi"(message queue in=w30, message="Reset CVM") -> (message queue out=w37, error out=w38)
        call "Enqueue Message (Single).gvi"(message queue in=w37, message="PV Config", message data=w36, error in=w38) -> (message queue out=w33, error out=w32)
        w31 = default
      }
      on "Heat Button" Value changed {
        call "Enqueue Message (Single).gvi"(message queue in=w30, message="Reset CVM") -> (message queue out=w39, error out=w40)
        call "Enqueue Message (Single).gvi"(message queue in=w39, message="Heat Config", message data=$"Heat Selector", error in=w40) -> (message queue out=w33, error out=w32)
        w31 = default
      }
      on "MV-Heating" Value changed {
        Event Data() -> ("New Value"=w41)
        call "Enqueue Message (Single).gvi"(message queue in=w30, message="Reset CVM") -> (message queue out=w42, error out=w43)
        call "Enqueue Message (Single).gvi"(message queue in=w42, message="Heat Config", message data=w41, error in=w43) -> (message queue out=w33, error out=w32)
        w31 = default
      }
      on "Set PV Angle Button" Value changed {
        call "Enqueue Message (Single).gvi"(message queue in=w30, message="Reset CVM") -> (message queue out=w44, error out=w45)
        call "Enqueue Message (Single).gvi"(message queue in=w44, message="Set PV Angle", message data=$"PV Angle", error in=w45) -> (message queue out=w33, error out=w32)
        w31 = default
      }
      on "MV-Panel Tilt Angle" Value changed {
        call "Enqueue Message (Single).gvi"(message queue in=w30, message="Reset CVM") -> (message queue out=w46, error out=w47)
        Event Data() -> ("New Value"=w48)
        Decimal String To Number(string=w48) -> (offset past number=w49)
        call "Enqueue Message (Single).gvi"(message queue in=w46, message="Set PV Angle", message data=w49, error in=w47) -> (message queue out=w33, error out=w32)
        w31 = default
      }
      on "IR Thermometer Position" Value changed {
        call "Enqueue Message (Single).gvi"(message queue in=w30, message="Reset CVM") -> (message queue out=w50, error out=w51)
        call "Enqueue Message (Single).gvi"(message queue in=w50, message="IR Thermometer Position", message data=$"IR Thermometer Position Selector", error in=w51) -> (message queue out=w33, error out=w32)
        w31 = default
      }
      on "Fans Button" Value changed {
        call "Enqueue Message (Single).gvi"(message queue in=w30, message="Reset CVM") -> (message queue out=w52, error out=w53)
        call "Enqueue Message (Single).gvi"(message queue in=w52, message="Fans Control", message data=$"Fans Selector", error in=w53) -> (message queue out=w33, error out=w32)
        w31 = default
      }
      on "MV-Cooling" Value changed {
        Event Data() -> ("New Value"=w54)
        call "Enqueue Message (Single).gvi"(message queue in=w30, message="Reset CVM") -> (message queue out=w55, error out=w56)
        call "Enqueue Message (Single).gvi"(message queue in=w55, message="Fans Control", message data=w54, error in=w56) -> (message queue out=w33, error out=w32)
        w31 = default
      }
      on "Brightness Config Button" Value changed {
        call "Enqueue Message (Single).gvi"(message queue in=w30, message="Reset CVM") -> (message queue out=w57, error out=w58)
        call "Enqueue Message (Single).gvi"(message queue in=w57, message="Brightness Config", message data=$Brightness, error in=w58) -> (message queue out=w33, error out=w32)
        w31 = default
      }
      on "MV-Light Power" Value changed {
        Event Data() -> ("New Value"=w59)
        call "Enqueue Message (Single).gvi"(message queue in=w30, message="Reset CVM") -> (message queue out=w60, error out=w61)
        call "Enqueue Message (Single).gvi"(message queue in=w60, message="Brightness Config", message data=w59, error in=w61) -> (message queue out=w33, error out=w32)
        w31 = default
      }
      on "Optic Filter Config Button" Value changed {
        call "Enqueue Message (Single).gvi"(message queue in=w30, message="Reset CVM") -> (message queue out=w62, error out=w63)
        call "Enqueue Message (Single).gvi"(message queue in=w62, message="Optic Filter Config", message data=$"Optic Filter Selector", error in=w63) -> (message queue out=w33, error out=w32)
        w31 = default
      }
      on "MV-Optical Filter" Value changed {
        Event Data() -> ("New Value"=w64)
        call "Enqueue Message (Single).gvi"(message queue in=w30, message="Reset CVM") -> (message queue out=w65, error out=w66)
        call "Enqueue Message (Single).gvi"(message queue in=w65, message="Optic Filter Config", message data=w64, error in=w66) -> (message queue out=w33, error out=w32)
        w31 = default
      }
      on "Prepare CVM" Value changed {
        call "Enqueue Message (Single).gvi"(message queue in=w30, message="Prepare CVM") -> (message queue out=w33, error out=w32)
        w31 = default
      }
      on "Set LoadR" Value changed; "Set LoadRTotal" Value changed {
        call "Enqueue Message (Single).gvi"(message queue in=w30, message="Reset CVM") -> (message queue out=w67, error out=w68)
        Is Empty String Or Path(string/path=$"Set LoadRTotal") -> w69
        Concatenate Strings($LoadR1, $LoadR10, $LoadR100, $LoadR1000) -> w70
        Select(s=w69, t=w70, f=$"Set LoadRTotal") -> w71
        call "Enqueue Message (Single).gvi"(message queue in=w67, message="Set LoadR", message data=w71, error in=w68) -> (message queue out=w33, error out=w32)
        w31 = default
      }
      on "MV-LoadRTotal" Value changed {
        Event Data() -> ("New Value"=w72)
        call "Enqueue Message (Single).gvi"(message queue in=w30, message="Reset CVM") -> (message queue out=w73, error out=w74)
        call "Enqueue Message (Single).gvi"(message queue in=w73, message="Set LoadR", message data=w72, error in=w74) -> (message queue out=w33, error out=w32)
        w31 = default
      }
      on "No Load" Value changed {
        call "Enqueue Message (Single).gvi"(message queue in=w30, message="Reset CVM") -> (message queue out=w75)
        call "Enqueue Message (Single).gvi"(message queue in=w75, message="NoLoad") -> (message queue out=w33, error out=w32)
        w31 = default
      }
      on "VAC Button" Value changed {
        call "Enqueue Message (Single).gvi"(message queue in=w30, message="VAC", message data=0) -> (message queue out=w33, error out=w32)
        $"VAC Load Counter" <- 0
        w31 = default
      }
    }
    call "Error Handler - Event Handling Loop.gvi"(message queue in=w33, error in=w32) -> (dup error in=w76)
    stop if w31
  }
  Unregister For Events(error in=w76, event registration refnum=s2)
  $"API Key" <- "zYUbuW0YNkg1G__lXfJiGVBNWME-HlVd2a5NUHp-IP"
  s3 = "UI Data.gtype" {all zero or empty}  # shift register
  s4 = T1 {"VISA Resource"="COM5", "Physical Channel"=""}  # shift register
  while {
    call "Dequeue Message.gvi"(message queue in=w30, error in=w29) -> (message queue out=w77, message=w78, message data=w79, error out=w80)
    $"Hardware Current Status" <- w78
    # s3: Data
    # s4: VISA
    # w26: Stop Event
    case (w78) ignore case {  # Message Cases
      frame "Initialize" {
        Flush Queue(error in=w80, queue=w77) -> (error out=w85, queue out=w86)
        call "Enqueue Message (Single).gvi"(message queue in=w86, message="Initialize VISA", error in=w85) -> (message queue out=w87, error out=w88)
        call "Enqueue Message (Single).gvi"(message queue in=w87, message="Initialize AI", error in=w88) -> (message queue out=w89, error out=w90)
        call "Enqueue Message (Single).gvi"(message queue in=w89, message="Set Arduino Status", error in=w90) -> (message queue out=w91, error out=w92)
        call "Enqueue Message (Single).gvi"(message queue in=w91, message="Reset CVM", error in=w92) -> (message queue out=w93, error out=w94)
        call "Enqueue Message (Single).gvi"(message queue in=w93, message="NoLoad", error in=w94) -> (message queue out=w95, error out=w96)
        call "Enqueue Message (Single).gvi"(message queue in=w95, message="Brightness Config", message data=2, error in=w96) -> (message queue out=w97, error out=w98)
        call "Enqueue Message (Single).gvi"(message queue in=w97, message="Fans Control", message data="0", error in=w98) -> (message queue out=w99, error out=w100)
        call "Enqueue Message (Single).gvi"(message queue in=w99, message="Heat Config", message data="0", error in=w100) -> (message queue out=w101, error out=w102)
        call "Enqueue Message (Single).gvi"(message queue in=w101, message="Optic Filter Config", message data="No Filter", error in=w102) -> (message queue out=w103, error out=w104)
        call "Enqueue Message (Single).gvi"(message queue in=w103, message="IR Thermometer Position", message data="None", error in=w104) -> (message queue out=w105, error out=w106)
        call "Enqueue Message (Single).gvi"(message queue in=w105, message="Set PV Angle", message data=90, error in=w106) -> (message queue out=w107, error out=w108)
        call "Enqueue Message (Single).gvi"(message queue in=w107, message="Panel Config", message data="Parallel 4", error in=w108) -> (message queue out=w109, error out=w110)
        call "Enqueue Message (Single).gvi"(message queue in=w109, message="Wait For Event", error in=w110) -> (error out=w81)
        Build Array(reference to "Arduino Status", reference to "TempSensor Error", reference to "LuxSensor Error") -> w111
        for {
          w112 = each element of w111
          Property Node(instance in=w112, "Value"="none")
        }
        Build Array(reference to "TempSensor", reference to "LuxSensor", reference to "Recalculated Voltage", reference to "Voltage EndPoint", reference to "Voltage MidPoint", reference to "Recalculated Current", reference to "Current EndPoint", reference to "Current MidPoint", reference to "V Coeff", reference to "C Coeff") -> w113
        for {
          w114 = each element of w113
          Property Node(instance in=w114, "Value"=-1)
        }
        Property Node(instance in=reference to "Set LoadRTotal", "Value"="")
        Property Node(instance in=reference to "VAC Load Counter", "Value"=0)
        w82 = s3
        w83 = default
        w84 = s4
      }
      frame "Initialize VISA" {
        call "Configure Serial Port (Instr).gvi"(stop bits="1.0"(10), session in=$"VISA Resource Name", error in=w80, baud rate=115200, parity="None"(0), termination char=0xA, enable termination char=TRUE) -> (session out=w115, error out=w116)
        call "Open (Instr).gvi"(resource name=w115, error in=w116) -> (session out=w117, error out=w81)
        Property Node(instance in=s4, "VISA Resource"=w117) -> (instance out=w84)
        Wait(time to wait=2000)
        w82 = s3
        w83 = default
      }
      frame "Initialize AI" {
        call "DAQmx Create Channel (AI-Voltage-Basic).gvi"(error in=w80, physical channels="Dev1/ai0:1,Dev1/ai3,Dev1/ai7,Dev1/ai6", units="Volts"(10348), measurement range="ValueRange.gtype" {"maximum value"=10, "minimum value"=0}, input terminal configuration="RSE"(10083)) -> (task out=w118, error out=w81)
        Property Node(instance in=s4, "Physical Channel"=w118) -> (instance out=w84)
        w82 = s3
        w83 = default
      }
      frame "Wait For Event" {
        Wait(time to wait=100)
        call "Enqueue Message (Single).gvi"(message queue in=w77, message="Watchdog", error in=w80) -> (error out=w81)
        w82 = s3
        w83 = default
        w84 = s4
      }
      frame "Send CMD" {
        Property Node(instance in=s4) -> ("VISA Resource"=w119, instance out=w84)
        call "Enqueue Message (Single).gvi"(message queue in=w77, message="Wait For Event", error in=w80) -> (error out=w120)
        call "VISA ReadWrite.gvi"(VISA_IN=w119, CMD=$"Command to Arduino", ERROR_IN=w120) -> (Arduino_Reply=w121, ERROR_OUT=w81)
        $"Command reply" <- w121
        w82 = s3
        w83 = default
      }
      frame "Set Arduino Status" {
        Property Node(instance in=s4) -> ("VISA Resource"=w122, instance out=w84)
        call "VISA ReadWrite.gvi"(VISA_IN=w122, CMD="@TIME 10 CEPHEI#", ERROR_IN=w80) -> (ERROR_OUT=w81)
        w82 = s3
        w83 = default
      }
      frame "Watchdog" {
        Property Node(instance in=s4) -> ("Physical Channel"=w123, "VISA Resource"=w124, instance out=w84)
        call "VISA ReadWrite.gvi"(VISA_IN=w124, CMD="@TIME 10 ?#", ERROR_IN=w80) -> (OUTPUT=w125, Arduino_Reply=w126, ERROR_OUT=w127)
        Property Node(instance in=w126) -> ("DATA"=w128)
        call "VISA Reply Parse.gvi"(string=w128) -> (Reply String=w129)
        Match Pattern(regular expression="CEPHEI", string=w129) -> (match substring=w130)
        Is Equal(x=w130, y="CEPHEI") -> w131
        case (w131) {
          frame False, Default {
            Flush Queue(error in=w127, queue=w77) -> (error out=w132, queue out=w133)
            call "Enqueue Message (Single).gvi"(message queue in=w133, message="Initialize", error in=w132) -> (error out=w81)
          }
          frame True {
            call "VISA ReadWrite.gvi"(VISA_IN=w125, CMD="@LUX 10 1#", ERROR_IN=w127) -> (OUTPUT=w134, Arduino_Reply=w135, ERROR_OUT=w136)
            call "VISA ReadWrite.gvi"(VISA_IN=w134, CMD="@TEMP 8 0#", ERROR_IN=w136) -> (Arduino_Reply=w137, ERROR_OUT=w138)
            call "DAQmx Read (Analog 2D DBL NChan NSamp).gvi"(task in=w123, error in=w138, number of samples per channel=1) -> (error out=w139, data=w140)
            Array Index(array=w140) -> (out0[4, 0]=w141)
            Multiply(w141, 20) -> w142
            $"TempSensor IR" <- w142
            Array Index(array=w140) -> (out0[1, 0]=w143, out1[2, 0]=w144)
            Multiply(w143, 4) -> w145
            Multiply(w145, $"V Coeff") -> w146
            Feedback Node(input=w147) -> w148
            Build Array(w148, w146) -> w147
            $Voltage_Graph <- w147
            $"Recalculated Voltage" <- w146
            $"Voltage EndPoint" <- w143
            $"Voltage MidPoint" <- w144
            Array Index(array=w140) -> (out0[0, 0]=w149, out1[3, 0]=w150)
            Divide(x=w149, y=70) -> w151
            Multiply(w151, 1000) -> w152
            Multiply(w152, $"C Coeff") -> w153
            Feedback Node(input=w154) -> w155
            Build Array(w155, w153) -> w154
            $Current_Graph <- w154
            $"Recalculated Current" <- w153
            $"Current EndPoint" <- w149
            $"Current MidPoint" <- w150
            call "DAQmx Read (Analog 1D Wfm NChan NSamp).gvi"(task in=w123, error in=w139, number of samples per channel=1) -> (error out=w156, data=w157)
            call "Enqueue Message (Single).gvi"(message queue in=w77, message="Wait For Event", error in=w156) -> (error out=w81)
            $"AI measurements" <- w157
            Property Node(instance in=reference to "PV-Current, mA", "Value"=w153)
            Property Node(instance in=w135) -> ("DATA"=w158, instance out=w159)
            $"LUXSensor Reply" <- w159
            Property Node(instance in=w137) -> ("DATA"=w160, instance out=w161)
            $"TempSensor Reply" <- w161
            Property Node(instance in=reference to "PV-Voltage, V", "Value"=w146)
            call "VISA Reply Parse.gvi"(string=w158) -> (Error code=w162, Reply=w163)
            Property Node(instance in=reference to "PV-LightIntensity, W/m2", "Value"=w163)
            call "VISA Reply Parse.gvi"(string=w160) -> (Error code=w164, Reply=w165)
            Property Node(instance in=$"Measured Data", "Voltage, V"=w146, "Current, mA"=w153, "Luminous Flux, Lux"=w163, "Temperature, GradC"=w165, "Temperature IR, GradC"=w142) -> (instance out=w166)
            $"Measured Data" <- w166
            $"LuxSensor Error" <- w162
            $"TempSensor Error" <- w164
            Property Node(instance in=reference to "PV-Temperature, ºC", "Value"=w165)
            $LuxSensor <- w163
            $TempSensor <- w165
          }
        }
        $"Arduino Status" <- w129
        w82 = s3
        w83 = default
      }
      frame "Panel Config" {
        call "Enqueue Message (Single).gvi"(message queue in=w77, message="Prepare CVM", error in=w80) -> (error out=w167)
        Variant To Data(error in (no error)=w167, type=string "", variant=w79) -> (data=w168, error out=w169)
        Property Node(instance in=s4) -> ("VISA Resource"=w170, instance out=w84)
        call "Panel Switch.gvi"(VISA_IN=w170, CTRL="Disconnect", ERROR_IN=w169) -> (VISA_OUT=w171, ERROR_OUT=w172)
        case (w168) {
          frame "Single" {
            w175 = ["@DO 17 0#", "@DO 18 1#", "@DO 23 1#", "@DO 24 1#", "@DO 25 1#", "@DO 26 0#", "@DO 27 0#", "@DO 28 0#", "@DO 29 1#", "@DO 30 1#", "@DO 31 1#", "@DO 32 1#", "@DO 33 0#"]
            w176 = ["@DO 54 1#", "@DO 55 1#", "@DO 56 1#", "@DO 57 1#", "@DO 58 1#", "@DO 59 1#", "@DO 60 1#", "@DO 61 1#"]
            # @DO 17 0#
            # @DO 18 1#
            # @DO 23 1#
            # @DO 24 1#
            # @DO 25 1#
            # @DO 26 0#
            # @DO 27 0#
            # @DO 28 0#
            # @DO 29 1#
            # @DO 30 1#
            # @DO 31 1#
            # @DO 32 1#
            # @DO 33 0#
            #
            # 03,08,2020
            # 19:51
            Insert Into Array(inArray=w175, new=w176) -> w177
            call "VISA Multiple Write.gvi"(VISA_IN=w171, ARRAY_IN=w177, ERROR_IN=w172) -> (ERROR_OUT=w173)
            w174 = w168
          }
          frame "Parallel 2" {
            # @DO 17 1#
            # @DO 18 0#
            # @DO 23 1#
            # @DO 24 0#
            # @DO 25 1#
            # @DO 26 1#
            # @DO 27 1#
            # @DO 28 1#
            # @DO 29 1#
            # @DO 30 1#
            # @DO 31 1#
            # @DO 32 1#
            # @DO 33 1#
            #
            # 03.08.2020
            # 19.53
            w178 = ["@DO 17 1#", "@DO 18 0#", "@DO 23 1#", "@DO 24 0#", "@DO 25 1#", "@DO 26 1#", "@DO 27 1#", "@DO 28 1#", "@DO 29 1#", "@DO 30 1#", "@DO 31 1#", "@DO 32 1#", "@DO 33 1#"]
            # Disconnect all Diodes
            w179 = ["@DO 54 1#", "@DO 55 1#", "@DO 56 1#", "@DO 57 1#", "@DO 58 1#", "@DO 59 1#", "@DO 60 1#", "@DO 61 1#"]
            Insert Into Array(inArray=w178, new=w179) -> w180
            call "VISA Multiple Write.gvi"(VISA_IN=w171, ARRAY_IN=w180, ERROR_IN=w172) -> (ERROR_OUT=w173)
            w174 = w168
          }
          frame "Parallel 2 Diode" {
            # @DO 17 1#
            # @DO 18 0#
            # @DO 23 1#
            # @DO 24 0#
            # @DO 25 1#
            # @DO 26 1#
            # @DO 27 1#
            # @DO 28 1#
            # @DO 29 1#
            # @DO 30 1#
            # @DO 31 1#
            # @DO 32 1#
            # @DO 33 1#
            #
            # 03.08.2020
            # 19.54
            w181 = ["@DO 17 1#", "@DO 18 0#", "@DO 23 1#", "@DO 24 0#", "@DO 25 1#", "@DO 26 1#", "@DO 27 1#", "@DO 28 1#", "@DO 29 1#", "@DO 30 1#", "@DO 31 1#", "@DO 32 1#", "@DO 33 1#"]
            # @DO 56 0#
            # @DO 57 0#
            #
            # 19.54
            w182 = ["@DO 54 1#", "@DO 55 1#", "@DO 56 0#", "@DO 57 0#", "@DO 58 1#", "@DO 59 1#", "@DO 60 1#", "@DO 61 1#"]
            Insert Into Array(inArray=w181, new=w182) -> w183
            call "VISA Multiple Write.gvi"(VISA_IN=w171, ARRAY_IN=w183, ERROR_IN=w172) -> (ERROR_OUT=w173)
            w174 = w168
          }
          frame "Series 2" {
            # @DO 17 0#
            # @DO 18 1#
            # @DO 23 1#
            # @DO 24 0#
            # @DO 25 1#
            # @DO 26 1#
            # @DO 27 1#
            # @DO 28 1#
            # @DO 29 0#
            # @DO 30 1#
            # @DO 31 1#
            # @DO 32 0#
            # @DO 33 0#
            #
            # 03.08.2020
            # 19.55
            w184 = ["@DO 17 0#", "@DO 18 1#", "@DO 23 1#", "@DO 24 0#", "@DO 25 1#", "@DO 26 1#", "@DO 27 1#", "@DO 28 1#", "@DO 29 0#", "@DO 30 1#", "@DO 31 1#", "@DO 32 0#", "@DO 33 0#"]
            w185 = ["@DO 54 1#", "@DO 55 1#", "@DO 56 1#", "@DO 57 1#", "@DO 58 1#", "@DO 59 1#", "@DO 60 1#", "@DO 61 1#"]
            Insert Into Array(inArray=w184, new=w185) -> w186
            call "VISA Multiple Write.gvi"(VISA_IN=w171, ARRAY_IN=w186, ERROR_IN=w172) -> (ERROR_OUT=w173)
            w174 = w168
          }
          frame "Series 2 Diode" {
            # @DO 17 0#
            # @DO 18 1#
            # @DO 23 1#
            # @DO 24 0#
            # @DO 25 1#
            # @DO 26 1#
            # @DO 27 1#
            # @DO 28 1#
            # @DO 29 0#
            # @DO 30 1#
            # @DO 31 1#
            # @DO 32 0#
            # @DO 33 0#
            #
            # 03.08.2020
            # 19.57
            w187 = ["@DO 17 0#", "@DO 18 1#", "@DO 23 1#", "@DO 24 0#", "@DO 25 1#", "@DO 26 1#", "@DO 27 1#", "@DO 28 1#", "@DO 29 0#", "@DO 30 1#", "@DO 31 1#", "@DO 32 0#", "@DO 33 0#"]
            # @DO 60 0#
            # @DO 61 0#
            #
            # 03.08.2020
            w188 = ["@DO 54 1#", "@DO 55 1#", "@DO 56 1#", "@DO 57 1#", "@DO 58 1#", "@DO 59 1#", "@DO 60 0#", "@DO 61 0#"]
            Insert Into Array(inArray=w187, new=w188) -> w189
            call "VISA Multiple Write.gvi"(VISA_IN=w171, ARRAY_IN=w189, ERROR_IN=w172) -> (ERROR_OUT=w173)
            w174 = w168
          }
          frame "Parallel 4", Default {
            # @DO 17 1#
            # @DO 18 1#
            # @DO 23 1#
            # @DO 24 1#
            # @DO 25 1#
            # @DO 26 1#
            # @DO 27 1#
            # @DO 28 1#
            # @DO 29 1#
            # @DO 30 1#
            # @DO 31 1#
            # @DO 32 1#
            # @DO 33 1#
            #
            # 03.08.2020
            # 19.59
            w190 = ["@DO 17 1#", "@DO 18 1#", "@DO 23 1#", "@DO 24 1#", "@DO 25 1#", "@DO 26 1#", "@DO 27 1#", "@DO 28 1#", "@DO 29 1#", "@DO 30 1#", "@DO 31 1#", "@DO 32 1#", "@DO 33 1#"]
            w191 = ["@DO 54 1#", "@DO 55 1#", "@DO 56 1#", "@DO 57 1#", "@DO 58 1#", "@DO 59 1#", "@DO 60 1#", "@DO 61 1#"]
            Insert Into Array(inArray=w190, new=w191) -> w192
            call "VISA Multiple Write.gvi"(VISA_IN=w171, ARRAY_IN=w192, ERROR_IN=w172) -> (ERROR_OUT=w173)
            w174 = "Parallel 4"
          }
          frame "Parallel 4 Diode" {
            # @DO 17 1#
            # @DO 18 1#
            # @DO 23 1#
            # @DO 24 1#
            # @DO 25 1#
            # @DO 26 1#
            # @DO 27 1#
            # @DO 28 1#
            # @DO 29 1#
            # @DO 30 1#
            # @DO 31 1#
            # @DO 32 1#
            # @DO 33 1#
            # 03.08.2020
            # 20.00
            w193 = ["@DO 17 1#", "@DO 18 1#", "@DO 23 1#", "@DO 24 1#", "@DO 25 1#", "@DO 26 1#", "@DO 27 1#", "@DO 28 1#", "@DO 29 1#", "@DO 30 1#", "@DO 31 1#", "@DO 32 1#", "@DO 33 1#"]
            # @DO 54 0#
            # @DO 55 0#
            # @DO 56 0#
            # @DO 57 0#
            #
            # 03.08.2020
            # 20.00
            w194 = ["@DO 54 0#", "@DO 55 0#", "@DO 56 0#", "@DO 57 0#", "@DO 58 1#", "@DO 59 1#", "@DO 60 1#", "@DO 61 1#"]
            Insert Into Array(inArray=w193, new=w194) -> w195
            call "VISA Multiple Write.gvi"(VISA_IN=w171, ARRAY_IN=w195, ERROR_IN=w172) -> (ERROR_OUT=w173)
            w174 = w168
          }
          frame "Series 4" {
            # @DO 17 0#
            # @DO 18 1#
            # @DO 23 0#
            # @DO 24 1#
            # @DO 25 1#
            # @DO 26 0#
            # @DO 27 0#
            # @DO 28 0#
            # @DO 29 0#
            # @DO 30 0#
            # @DO 31 0#
            # @DO 32 0#
            # @DO 33 0#
            #
            # 03.08.2020
            # 20.02
            w196 = ["@DO 17 0#", "@DO 18 1#", "@DO 23 0#", "@DO 24 1#", "@DO 25 1#", "@DO 26 0#", "@DO 27 0#", "@DO 28 0#", "@DO 29 0#", "@DO 30 0#", "@DO 31 0#", "@DO 32 0#", "@DO 33 0#"]
            w197 = ["@DO 54 1#", "@DO 55 1#", "@DO 56 1#", "@DO 57 1#", "@DO 58 1#", "@DO 59 1#", "@DO 60 1#", "@DO 61 1#"]
            Insert Into Array(inArray=w196, new=w197) -> w198
            call "VISA Multiple Write.gvi"(VISA_IN=w171, ARRAY_IN=w198, ERROR_IN=w172) -> (ERROR_OUT=w173)
            w174 = w168
          }
          frame "Series 4 Diode" {
            # @DO 17 0#
            # @DO 18 1#
            # @DO 23 0#
            # @DO 24 1#
            # @DO 25 1#
            # @DO 26 0#
            # @DO 27 0#
            # @DO 28 0#
            # @DO 29 0#
            # @DO 30 0#
            # @DO 31 0#
            # @DO 32 0#
            # @DO 33 0#
            #
            # 03.08.2020
            # 20.03
            w199 = ["@DO 17 0#", "@DO 18 1#", "@DO 23 0#", "@DO 24 1#", "@DO 25 1#", "@DO 26 0#", "@DO 27 0#", "@DO 28 0#", "@DO 29 0#", "@DO 30 0#", "@DO 31 0#", "@DO 32 0#", "@DO 33 0#"]
            # @DO 58 0#
            # @DO 59 0#
            # @DO 60 0#
            # @DO 61 0#
            #
            # 03.08.2020
            # 20.04
            w200 = ["@DO 54 1#", "@DO 55 1#", "@DO 56 1#", "@DO 57 1#", "@DO 58 0#", "@DO 59 0#", "@DO 60 0#", "@DO 61 0#"]
            Insert Into Array(inArray=w199, new=w200) -> w201
            call "VISA Multiple Write.gvi"(VISA_IN=w171, ARRAY_IN=w201, ERROR_IN=w172) -> (ERROR_OUT=w173)
            w174 = w168
          }
          frame "Parallel Of Series" {
            # @DO 17 1#
            # @DO 18 1#
            # @DO 23 1#
            # @DO 24 1#
            # @DO 25 1#
            # @DO 26 1#
            # @DO 27 0#
            # @DO 28 1#
            # @DO 29 0#
            # @DO 30 0#
            # @DO 31 1#
            # @DO 32 0#
            # @DO 33 1#
            #
            # 03.08.2020
            # 20.05
            w202 = ["@DO 17 1#", "@DO 18 1#", "@DO 23 1#", "@DO 24 1#", "@DO 25 1#", "@DO 26 1#", "@DO 27 0#", "@DO 28 1#", "@DO 29 0#", "@DO 30 0#", "@DO 31 1#", "@DO 32 0#", "@DO 33 1#"]
            w203 = ["@DO 54 1#", "@DO 55 1#", "@DO 56 1#", "@DO 57 1#", "@DO 58 1#", "@DO 59 1#", "@DO 60 1#", "@DO 61 1#"]
            Insert Into Array(inArray=w202, new=w203) -> w204
            call "VISA Multiple Write.gvi"(VISA_IN=w171, ARRAY_IN=w204, ERROR_IN=w172) -> (ERROR_OUT=w173)
            w174 = w168
          }
          frame "Parallel Of Series Diode" {
            # @DO 17 1#
            # @DO 18 1#
            # @DO 23 1#
            # @DO 24 1#
            # @DO 25 1#
            # @DO 26 1#
            # @DO 27 0#
            # @DO 28 1#
            # @DO 29 0#
            # @DO 30 0#
            # @DO 31 1#
            # @DO 32 0#
            # @DO 33 1#
            #
            # 03.08.2020
            # 20.06
            # @DO 58 0#
            # @DO 59 0#
            # @DO 60 0#
            # @DO 61 0#
            #
            # 03.08.2020
            # 20.097
            w205 = ["@DO 17 1#", "@DO 18 1#", "@DO 23 1#", "@DO 24 1#", "@DO 25 1#", "@DO 26 1#", "@DO 27 0#", "@DO 28 1#", "@DO 29 0#", "@DO 30 0#", "@DO 31 1#", "@DO 32 0#", "@DO 33 1#"]
            w206 = ["@DO 54 1#", "@DO 55 1#", "@DO 56 1#", "@DO 57 1#", "@DO 58 0#", "@DO 59 0#", "@DO 60 0#", "@DO 61 0#"]
            Insert Into Array(inArray=w205, new=w206) -> w207
            call "VISA Multiple Write.gvi"(VISA_IN=w171, ARRAY_IN=w207, ERROR_IN=w172) -> (ERROR_OUT=w173)
            w174 = w168
          }
          frame "Series Of Parallel" {
            w208 = ["@DO 54 1#", "@DO 55 1#", "@DO 56 1#", "@DO 57 1#", "@DO 58 1#", "@DO 59 1#", "@DO 60 1#", "@DO 61 1#"]
            # @DO 17 1#
            # @DO 18 0#
            # @DO 23 0#
            # @DO 24 0#
            # @DO 25 0#
            # @DO 26 1#
            # @DO 27 1#
            # @DO 28 1#
            # @DO 29 1#
            # @DO 30 1#
            # @DO 31 1#
            # @DO 32 1#
            # @DO 33 1#
            #
            # 03.08.2020
            # 20.07
            w209 = ["@DO 17 1#", "@DO 18 0#", "@DO 23 0#", "@DO 24 0#", "@DO 25 0#", "@DO 26 1#", "@DO 27 1#", "@DO 28 1#", "@DO 29 1#", "@DO 30 1#", "@DO 31 1#", "@DO 32 1#", "@DO 33 1#"]
            Insert Into Array(inArray=w209, new=w208) -> w210
            call "VISA Multiple Write.gvi"(VISA_IN=w171, ARRAY_IN=w210, ERROR_IN=w172) -> (ERROR_OUT=w173)
            w174 = w168
          }
          frame "Series Of Parallel Diode" {
            # @DO 17 1#
            # @DO 18 0#
            # @DO 23 0#
            # @DO 24 0#
            # @DO 25 0#
            # @DO 26 1#
            # @DO 27 1#
            # @DO 28 1#
            # @DO 29 1#
            # @DO 30 1#
            # @DO 31 1#
            # @DO 32 1#
            # @DO 33 1#
            #
            # 03.08.2020
            # 20.08
            w211 = ["@DO 17 1#", "@DO 18 0#", "@DO 23 0#", "@DO 24 0#", "@DO 25 0#", "@DO 26 1#", "@DO 27 1#", "@DO 28 1#", "@DO 29 1#", "@DO 30 1#", "@DO 31 1#", "@DO 32 1#", "@DO 33 1#"]
            # @DO 54 0#
            # @DO 55 0#
            # @DO 56 0#
            # @DO 57 0#
            #
            # 20.09
            # 03.08.2020
            w212 = ["@DO 54 0#", "@DO 55 0#", "@DO 56 0#", "@DO 57 0#", "@DO 58 1#", "@DO 59 1#", "@DO 60 1#", "@DO 61 1#"]
            Insert Into Array(inArray=w211, new=w212) -> w213
            call "VISA Multiple Write.gvi"(VISA_IN=w171, ARRAY_IN=w213, ERROR_IN=w172) -> (ERROR_OUT=w173)
            w174 = w168
          }
        }
        Property Node(instance in=reference to "PV-Panel Cofiguration", "ValueSignaling"=w174)
        call "Panel Switch.gvi"(VISA_IN=w170, CTRL="Connect", ERROR_IN=w173) -> (ERROR_OUT=w81)
        w82 = s3
        w83 = default
      }
      frame "Prepare CVM" {
        Property Node(instance in=s4) -> ("VISA Resource"=w214, "Physical Channel"=w215, instance out=w84)
        call "DAQmx Read (Analog 2D DBL NChan NSamp).gvi"(task in=w215, error in=w80, number of samples per channel=1) -> (error out=w216, data=w217)
        Array Index(array=w217) -> (out0[2, 0]=w218)
        Multiply(w218, 4) -> w219
        C Code Node("x"=w219, Error In=w216) -> ("y"=w220, Error Out=w221)
        ~~~
        if(x>-1 && x<=1)
          y = 0;
        if(x>1 && x<=10)
          y = 3;
        if(x>10 && x<=20)
          y = 2;
        if(x>20 && x<=30)
          y = 1;
        ~~~
        Array Index(array=w217) -> (out0[3, 0]=w222)
        # Tip For Local Wiring Solution
        # Relay 1(50) 	DO 1- REP A x1
        # 		DO 0- AMP A x10
        #
        # Relay 2(51) 	DO 1-REP V x1
        # 		DO 0-DIV V x0.25
        # Relay 3(52) 	DO 1-REP V x1
        # 		DO 0-DIV V x0.5
        # Relay 4(53) 	DO 1-REP V x1
        # 		DO 0-AMP V x10
        C Code Node("x"=w222, Error In=w221) -> ("y"=w223, Error Out=w224)
        ~~~
        if(x>-1 && x<=0.6)
          y = 0;
        if(x>0.6 && x<=6)
          y = 1;
        ~~~
        # Voltage Range
        case (w220) {
          frame 0, Default {
            call "VISA Multiple Write.gvi"(VISA_IN=w214, ARRAY_IN=["@DO 51 1#", "@DO 52 1#", "@DO 53 0#"], ERROR_IN=w224) -> (VISA Answer=w227, ERROR_OUT=w225)
            w226 = 0.1
          }
          frame 1 {
            call "VISA Multiple Write.gvi"(VISA_IN=w214, ARRAY_IN=["@DO 51 1#", "@DO 52 1#", "@DO 53 1#"], ERROR_IN=w224) -> (VISA Answer=w227, ERROR_OUT=w225)
            w226 = 1
          }
          frame 2 {
            call "VISA Multiple Write.gvi"(VISA_IN=w214, ARRAY_IN=["@DO 51 1#", "@DO 52 0#", "@DO 53 1#"], ERROR_IN=w224) -> (VISA Answer=w227, ERROR_OUT=w225)
            w226 = 0.5
          }
          frame 3 {
            # Div x0.25 works with 2 relay
            call "VISA Multiple Write.gvi"(VISA_IN=w214, ARRAY_IN=["@DO 51 0#", "@DO 52 0#", "@DO 53 1#"], ERROR_IN=w224) -> (VISA Answer=w227, ERROR_OUT=w225)
            w226 = 0.25
          }
        }
        $"V Coeff" <- w226
        $"VISA Answer_2" <- w227
        # Current Range
        case (w223) {
          frame 0, Default {
            call "VISA Multiple Write.gvi"(VISA_IN=w214, ARRAY_IN=["@DO 50 0#"], ERROR_IN=w225) -> (ERROR_OUT=w81)
            w228 = 0.1
          }
          frame 1 {
            call "VISA Multiple Write.gvi"(VISA_IN=w214, ARRAY_IN=["@DO 50 1#"], ERROR_IN=w225) -> (ERROR_OUT=w81)
            w228 = 1
          }
        }
        $"C Coeff" <- w228
        w82 = s3
        w83 = default
      }
      frame "Reset CVM" {
        $"V Coeff" <- 1
        $"C Coeff" <- 1
        Property Node(instance in=s4) -> ("VISA Resource"=w229, instance out=w84)
        # VOLTAGE RANGE
        # @DO 51 0#
        # @DO 52 0#
        # @DO 53 0#
        call "VISA Multiple Write.gvi"(VISA_IN=w229, ARRAY_IN=["@DO 51 1#", "@DO 52 1#", "@DO 53 1#"], ERROR_IN=w80) -> (VISA_OUT=w230, ERROR_OUT=w231)
        # CURRENT RANGE
        # @DO 50 1#
        call "VISA Multiple Write.gvi"(VISA_IN=w230, ARRAY_IN=["@DO 50 1#"], ERROR_IN=w231) -> (ERROR_OUT=w81)
        w82 = s3
        w83 = default
      }
      frame "VAC" {
        w232 = ["0", "1,", "10,", "20,10,", "50,", "50,20,", "100,", "100,40,10,", "200,100,", "500,100,", "1000,", "2000,", "2000,1000,", "4000,", "4000,1000,", "4000,2000,", "4000,2000,1000,", "4000,2000,1000,500,400,100,"]
        Variant To Data(type=i32 5, variant=w79) -> (data=w233)
        Array Size(array=w232) -> (size(s)=w234)
        Is Less Or Equal(x=$"VAC Load Counter", y=w234) -> w235
        Is Greater Or Equal(x=w233, y=i32 5) -> w236
        Logical And(w236, w235) -> w237
        case (w237) {
          frame False, Default {
            case (w235) {
              frame False, Default {
                Flush Queue(error in=w80, queue=w77) -> (error out=w239, queue out=w240)
                call "Enqueue Message (Single).gvi"(message queue in=w240, message="Reset CVM", error in=w239) -> (message queue out=w241, error out=w242)
                call "Enqueue Message (Single).gvi"(message queue in=w241, message="NoLoad", error in=w242) -> (message queue out=w243, error out=w244)
                call "Enqueue Message (Single).gvi"(message queue in=w243, message="Watchdog", error in=w244) -> (error out=w81)
                w238 = 0
              }
              frame True {
                Flush Queue(error in=w80, queue=w77) -> (error out=w245, queue out=w246)
                call "Enqueue Message (Single).gvi"(message queue in=w246, message="Watchdog", error in=w245) -> (message queue out=w247, error out=w248)
                Increment(x=w233) -> w249
                call "Enqueue Message (Single).gvi"(message queue in=w247, message="VAC", message data=w249, error in=w248) -> (error out=w81)
                w238 = $"VAC Load Counter"
              }
            }
          }
          frame True {
            Array Index(array=w232) -> (out0[$"VAC Load Counter"]=w250)
            Flush Queue(error in=w80, queue=w77) -> (error out=w251, queue out=w252)
            call "Enqueue Message (Single).gvi"(message queue in=w252, message="Reset CVM", error in=w251) -> (message queue out=w253, error out=w254)
            call "Enqueue Message (Single).gvi"(message queue in=w253, message="Set LoadR", message data=w250, error in=w254) -> (message queue out=w255, error out=w256)
            call "Enqueue Message (Single).gvi"(message queue in=w255, message="Prepare CVM", error in=w256) -> (message queue out=w257, error out=w258)
            call "Enqueue Message (Single).gvi"(message queue in=w257, message="VAC", message data=0, error in=w258) -> (error out=w81)
            Increment(x=$"VAC Load Counter") -> w238
          }
        }
        $"VAC Load Counter" <- w238
        Property Node(instance in=s4) -> ("Physical Channel"=w259, instance out=w84)
        call "DAQmx Read (Analog 2D DBL NChan NSamp).gvi"(task in=w259, number of samples per channel=1) -> (data=w260)
        Array Index(array=w260) -> (out0[1, 0]=w261)
        Multiply(w261, 4) -> w262
        Feedback Node(input=w263) -> w264
        Build Array(w264, w262) -> w263
        Array Index(array=w260) -> (out0[0, 0]=w265)
        Divide(x=w265, y=70) -> w266
        Multiply(w266, 1000) -> w267
        Feedback Node(input=w268) -> w269
        Build Array(w269, w267) -> w268
        Build Cluster(w263, w268) -> w270
        $VAC <- w270
        w82 = s3
        w83 = default
      }
      frame "Optic Filter Config" {
        call "Enqueue Message (Single).gvi"(message queue in=w77, message="Prepare CVM", error in=w80) -> (error out=w271)
        Variant To Data(error in (no error)=w271, type=string "", variant=w79) -> (data=w272, error out=w273)
        case (w272) {
          frame "No Filter", Default {
            w274 = ["@SERV 3 90#", "@SERV 4 0#"]
            w275 = "No Filter"
          }
          frame "Filter 1" {
            w274 = ["@SERV 3 90#", "@SERV 4 0#", "@SERV 3 0#"]
            w275 = w272
          }
          frame "Filter 2" {
            w274 = ["@SERV 3 90#", "@SERV 4 0#", "@SERV 4 90#"]
            w275 = w272
          }
        }
        Property Node(instance in=reference to "PV-Optical Filter", "ValueSignaling"=w275)
        Property Node(instance in=s4) -> ("VISA Resource"=w276, instance out=w84)
        call "VISA Multiple Write.gvi"(VISA_IN=w276, ARRAY_IN=w274, ERROR_IN=w273) -> (ERROR_OUT=w81)
        w82 = s3
        w83 = default
      }
      frame "Fans Control" {
        call "Enqueue Message (Single).gvi"(message queue in=w77, message="Prepare CVM", error in=w80) -> (error out=w277)
        Variant To Data(error in (no error)=w277, type=string "", variant=w79) -> (data=w278, error out=w279)
        case (w278) {
          frame "0", Default {
            w280 = ["@DO 11 0#", "@DO 12 0#"]
            w281 = "0"
          }
          frame "100" {
            w280 = ["@PWM 11 255#", "@PWM 12 255#"]
            w281 = "100"
          }
          frame "50" {
            w280 = ["@PWM 11 127#", "@PWM 12 127#"]
            w281 = "50"
          }
        }
        Property Node(instance in=reference to "PV-Cooling", "ValueSignaling"=w281)
        Property Node(instance in=s4) -> ("VISA Resource"=w282, instance out=w84)
        call "VISA Multiple Write.gvi"(VISA_IN=w282, ARRAY_IN=w280, ERROR_IN=w279) -> (ERROR_OUT=w81)
        w82 = s3
        w83 = default
      }
      frame "Heat Config" {
        call "Enqueue Message (Single).gvi"(message queue in=w77, message="Prepare CVM", error in=w80) -> (error out=w283)
        Variant To Data(error in (no error)=w283, type=string "", variant=w79) -> (data=w284, error out=w285)
        case (w284) {
          frame "0", Default {
            w286 = ["@DO 9 0#"]
            w287 = "0"
          }
          frame "50" {
            w286 = ["@PWM 9 125#"]
            w287 = "50"
          }
          frame "100" {
            w286 = ["@PWM 9 255#"]
            w287 = "100"
          }
        }
        Property Node(instance in=reference to "PV-Heating", "ValueSignaling"=w287)
        Property Node(instance in=s4) -> ("VISA Resource"=w288, instance out=w84)
        call "VISA Multiple Write.gvi"(VISA_IN=w288, ARRAY_IN=w286, ERROR_IN=w285) -> (ERROR_OUT=w81)
        w82 = s3
        w83 = default
      }
      frame "Set PV Angle" {
        call "Enqueue Message (Single).gvi"(message queue in=w77, message="Prepare CVM", error in=w80) -> (error out=w289)
        Variant To Data(error in (no error)=w289, type=u32 0, variant=w79) -> (data=w290, error out=w291)
        # Set angle limits for PV panels
        In Range And Coerce(lower limit=0, upper limit=180, x=w290) -> (coerced(x)=w292)
        Property Node(instance in=reference to "PV-Panel Tilt Angle, º", "ValueSignaling"=w292)
        Property Node(instance in=s4) -> ("VISA Resource"=w293, instance out=w84)
        Number To Decimal String(number=w292) -> (decimal integer string=w294)
        Concatenate Strings("@SERV 13 ", w294, "#") -> w295
        call "VISA ReadWrite.gvi"(VISA_IN=w293, CMD=w295, ERROR_IN=w291) -> (ERROR_OUT=w81)
        w82 = s3
        w83 = default
      }
      frame "Brightness Config" {
        Property Node(instance in=s4) -> ("VISA Resource"=w296, instance out=w84)
        call "Enqueue Message (Single).gvi"(message queue in=w77, message="Prepare CVM", error in=w80) -> (error out=w297)
        Variant To Data(error in (no error)=w297, type=u32 0, variant=w79) -> (data=w298, error out=w299)
        # Set brightness limits
        In Range And Coerce(lower limit=0, upper limit=100, x=w298) -> (coerced(x)=w300)
        Number To Decimal String(number=w300) -> (decimal integer string=w301)
        Concatenate Strings("@DIM 6 ", w301, "#") -> w302
        call "VISA ReadWrite.gvi"(VISA_IN=w296, CMD=w302, ERROR_IN=w299) -> (ERROR_OUT=w81)
        w82 = s3
        w83 = default
      }
      frame "IR Thermometer Position" {
        Variant To Data(error in (no error)=w80, type=string "", variant=w79) -> (data=w303, error out=w304)
        case (w303) {
          frame "None", Default {
            w305 = "@SERV 5 0#"
            w306 = w303
          }
          frame "Panel 1" {
            w305 = "@SERV 5 50#"
            w306 = w303
          }
          frame "Panel 2" {
            w305 = "@SERV 5 75#"
            w306 = w303
          }
          frame "Panel 3" {
            w305 = "@SERV 5 110#"
            w306 = w303
          }
          frame "Panel 4" {
            w305 = "@SERV 5 130#"
            w306 = w303
          }
        }
        Property Node(instance in=reference to "PV-Temperature IR Position", "ValueSignaling"=w306)
        Property Node(instance in=s4) -> ("VISA Resource"=w307, instance out=w84)
        call "VISA ReadWrite.gvi"(VISA_IN=w307, CMD=w305, ERROR_IN=w304) -> (ERROR_OUT=w81)
        w82 = s3
        w83 = default
      }
      frame "Set LoadR" {
        Property Node(instance in=s4) -> ("VISA Resource"=w308, instance out=w84)
        call "Enqueue Message (Single).gvi"(message queue in=w77, message="Prepare CVM", error in=w80) -> (error out=w309)
        Variant To Data(error in (no error)=w309, type=string "", variant=w79) -> (data=w310, error out=w311)
        # Disconnect ALL load
        w312 = ["@DO 42 1#", "@DO 34 0#", "@DO 35 0#", "@DO 36 0#", "@DO 37 0#", "@DO 38 0#", "@DO 39 0#", "@DO 40 0#", "@DO 41 0#", "@DO 43 0#", "@DO 44 0#", "@DO 45 0#", "@DO 46 0#", "@DO 47 0#", "@DO 48 0#", "@DO 49 0#"]
        sequence {
          frame 0 {
            call "VISA Multiple Write.gvi"(VISA_IN=w308, ARRAY_IN=w312, ERROR_IN=w311) -> (VISA_OUT=w313, ERROR_OUT=w314)
            $"Total Set LoadR" <- 1
          }
        }
        s5 = w310  # shift register
        s6 = 0  # shift register
        s7 = ""  # shift register
        while {
          Match Pattern(regular expression=",", string=s5) -> (after substring=w315, before substring=w316)
          s8 = w316  # shift register
          s9 = s6  # shift register
          while {
            Match Pattern(regular expression=",", string=s8) -> (after substring=w317, before substring=w318)
            case (w318) {
              frame "1" {
                call "VISA ReadWrite.gvi"(VISA_IN=w313, CMD="@DO 43 1#", ERROR_IN=w314) -> (ERROR_OUT=w319)
                w320 = w318
              }
              frame "2" {
                call "VISA ReadWrite.gvi"(VISA_IN=w313, CMD="@DO 44 1#", ERROR_IN=w314) -> (ERROR_OUT=w319)
                w320 = w318
              }
              frame "3" {
                call "VISA ReadWrite.gvi"(VISA_IN=w313, CMD="@DO 45 1#", ERROR_IN=w314) -> (ERROR_OUT=w319)
                w320 = w318
              }
              frame "5" {
                call "VISA ReadWrite.gvi"(VISA_IN=w313, CMD="@DO 46 1#", ERROR_IN=w314) -> (ERROR_OUT=w319)
                w320 = w318
              }
              frame "10" {
                call "VISA ReadWrite.gvi"(VISA_IN=w313, CMD="@DO 47 1#", ERROR_IN=w314) -> (ERROR_OUT=w319)
                w320 = w318
              }
              frame "20" {
                call "VISA ReadWrite.gvi"(VISA_IN=w313, CMD="@DO 48 1#", ERROR_IN=w314) -> (ERROR_OUT=w319)
                w320 = w318
              }
              frame "40" {
                call "VISA ReadWrite.gvi"(VISA_IN=w313, CMD="@DO 49 1#", ERROR_IN=w314) -> (ERROR_OUT=w319)
                w320 = w318
              }
              frame "50" {
                call "VISA ReadWrite.gvi"(VISA_IN=w313, CMD="@DO 34 1#", ERROR_IN=w314) -> (ERROR_OUT=w319)
                w320 = w318
              }
              frame "100" {
                call "VISA ReadWrite.gvi"(VISA_IN=w313, CMD="@DO 35 1#", ERROR_IN=w314) -> (ERROR_OUT=w319)
                w320 = w318
              }
              frame "200" {
                call "VISA ReadWrite.gvi"(VISA_IN=w313, CMD="@DO 36 1#", ERROR_IN=w314) -> (ERROR_OUT=w319)
                w320 = w318
              }
              frame "400" {
                call "VISA ReadWrite.gvi"(VISA_IN=w313, CMD="@DO 37 1#", ERROR_IN=w314) -> (ERROR_OUT=w319)
                w320 = w318
              }
              frame "500" {
                call "VISA ReadWrite.gvi"(VISA_IN=w313, CMD="@DO 38 1#", ERROR_IN=w314) -> (ERROR_OUT=w319)
                w320 = w318
              }
              frame "1000" {
                call "VISA ReadWrite.gvi"(VISA_IN=w313, CMD="@DO 39 1#", ERROR_IN=w314) -> (ERROR_OUT=w319)
                w320 = w318
              }
              frame "2000" {
                call "VISA ReadWrite.gvi"(VISA_IN=w313, CMD="@DO 40 1#", ERROR_IN=w314) -> (ERROR_OUT=w319)
                w320 = w318
              }
              frame "4000" {
                call "VISA ReadWrite.gvi"(VISA_IN=w313, CMD="@DO 41 1#", ERROR_IN=w314) -> (ERROR_OUT=w319)
                w320 = w318
              }
              frame "0", Default {
                # Short Circut
                # Схема сопротивления
                # 1 Ом + 1 Ом токовый резистор
                w319 = w314
                w320 = "Short Circuit (<1 Ohm)"
              }
            }
            Decimal String To Number(string=w320) -> (number=w321)
            Add(w321, s9) -> w322
            $"Total Set LoadR" <- w322
            Concatenate Strings(s7, ",", w320) -> w323
            $"Total LoadR_SET" <- w323
            Is Empty String Or Path(string/path=w317) -> w324
            next s8 = w317
            next s9 = w322
            stop if w324
          }
          Is Empty String Or Path(string/path=w315) -> w325
          next s5 = w315
          next s6 = s9
          next s7 = w323
          stop if w325
        }
        # Connect Load
        call "VISA ReadWrite.gvi"(VISA_IN=w308, CMD="@DO 42 0#", ERROR_IN=w319) -> (ERROR_OUT=w81)
        $"Total Set LoadR" <- s6
        Property Node(instance in=reference to "PV-LoadR,Ohm", "ValueSignaling"=s6)
        $"Total LoadR_SET" <- s7
        Property Node(instance in=reference to "PV-LoadRTotal", "ValueSignaling"=s7)
        w82 = s3
        w83 = default
      }
      frame "NoLoad" {
        # Сопротивление в начальное положение
        Property Node(instance in=reference to "PV-LoadRTotal", "ValueSignaling"="Disconnected (NO LOAD)")
        Property Node(instance in=reference to "Set LoadRTotal", "Value"="")
        $"Total LoadR_SET" <- "Disconnected (NO LOAD)"
        Property Node(instance in=reference to "PV-LoadR,Ohm", "ValueSignaling"=-1)
        $"Total Set LoadR" <- -1
        Property Node(instance in=s4) -> ("VISA Resource"=w326, instance out=w84)
        call "Enqueue Message (Single).gvi"(message queue in=w77, message="Prepare CVM", error in=w80) -> (error out=w327)
        # Disconnect all Load adn breake circuit
        # NO LOAD
        # Размыкаются всё реле, сопротивление- бесконечность
        w328 = ["@DO 42 1#", "@DO 34 1#", "@DO 35 1#", "@DO 36 1#", "@DO 37 1#", "@DO 38 1#", "@DO 39 1#", "@DO 40 1#", "@DO 41 1#", "@DO 43 1#", "@DO 44 1#", "@DO 45 1#", "@DO 46 1#", "@DO 47 1#", "@DO 48 1#", "@DO 49 1#"]
        call "VISA Multiple Write.gvi"(VISA_IN=w326, ARRAY_IN=w328, ERROR_IN=w327) -> (ERROR_OUT=w81)
        w82 = s3
        w83 = default
      }
      frame "Error" {
        Variant To Data(error in (no error)=w80, type=no error, variant=w79) -> (data=w329, error out=w81)
        # #CodeRecommended - If you ever change the name of this "Error" message, you'll need to update the name in the Check Loop Error.vi as well.
        call "Display Error.gvi"(error in=w329)
        w82 = s3
        w83 = default
        w84 = s4
      }
      frame "Exit" {
        Generate User Event(event data=TRUE, user event=w26) -> (error out=w330)
        Release Queue(error in=w80, queue=w77) -> (error out=w331)
        Property Node(instance in=s4) -> ("VISA Resource"=w332, "Physical Channel"=w333)
        call "DAQmx Stop Task.gvi"(task in=w333) -> (error out=w334)
        call "Close (Instr).gvi"(session in=w332, error in=w334) -> (error out=w335)
        Merge Errors(w335, w330, w331) -> (error out=w81)
        w82 = s3
        w83 = TRUE
        w84 = default
      }
      frame Default {
        w336 = "The invalid message string \"%s\" was received in the Message Handling Loop."
        Format Into String(formatString=w336, w78) -> w337
        call "Build Error Cluster.gvi"(code=1, description=w337) -> (error out=w81)
        w82 = s3
        w83 = default
        w84 = s4
      }
    }
    call "Error Handler - Message Handling Loop.gvi"(message queue in=w77, error in=w81) -> (dup error in=w338)
    next s3 = w82
    next s4 = w84
    stop if w83
  }
  $"Server URL" <- "https://api.systemlinkcloud.com/"
  $"Exit 2" <- FALSE
  $SendArrayDoubleToCloud <- "Send Measured Data To Cloud"
  $SendStringToCloud <- "Send String To Cloud"
  $SendDoubleToCloud <- "Send Double To Cloud"
  w339 = bool FALSE  # Stop Event
  Create User Event[EventName="Stop Event"](user event data type=w339) -> (error out=w340, user event out=w341)
  call "Create All Message Queues.gvi"(error in=w340) -> (message queues=w342, error out=w343)
  Property Node(instance in=w342) -> ("UI"=w344)
  s10 = "UI Data.gtype" {all zero or empty}  # shift register
  while {
    call "Dequeue Message.gvi"(message queue in=w344, error in=w343) -> (message queue out=w345, message=w346, message data=w347, error out=w348)
    # s10: Data
    # w341: Stop Event
    case (w346) ignore case {  # Message Cases
      frame "Initialize" {
        Property Node(instance in=s10, "String"=w346) -> (instance out=w350)
        call "Enqueue Message (Single).gvi"(message queue in=w345, message="Update Display", message data=w346, error in=w348) -> (message queue out=w352, error out=w353)
        # Bundle a sample string value.
        call "Enqueue Message (Single).gvi"(message queue in=w352, message=$SendArrayDoubleToCloud, error in=w353) -> (error out=w349)
        Property Node(instance in=reference to "PV-Temperature, ºC", "ValueSignaling"=0)
        Property Node(instance in=reference to "MV-Panel Configuration", "Value"="none")
        Property Node(instance in=reference to "PV-Panel Cofiguration", "ValueSignaling"="none")
        Property Node(instance in=reference to "MV-Heating", "Value"="none")
        Property Node(instance in=reference to "PV-Temperature IR, ºC", "ValueSignaling"=0)
        Property Node(instance in=reference to "PV-Heating", "ValueSignaling"="none")
        Property Node(instance in=reference to "MV-Cooling", "Value"="none")
        Property Node(instance in=reference to "PV-LightIntensity, W/m2", "ValueSignaling"=0)
        Property Node(instance in=reference to "PV-Cooling", "ValueSignaling"="none")
        Property Node(instance in=reference to "MV-Light Power", "Value"="none")
        Property Node(instance in=reference to "PV-Panel Tilt Angle, º", "ValueSignaling"=0)
        Property Node(instance in=reference to "PV-Optical Filter", "ValueSignaling"="none")
        Property Node(instance in=reference to "MV-Optical Filter", "Value"="none")
        Property Node(instance in=reference to "PV-LigthPower, %", "ValueSignaling"=0)
        Property Node(instance in=reference to "PV-LoadR4", "ValueSignaling"="none")
        Property Node(instance in=reference to "MV-Panel Tilt Angle", "Value"="none")
        Property Node(instance in=reference to "PV-Voltage, V", "ValueSignaling"=0)
        Property Node(instance in=reference to "PV-LoadR3", "ValueSignaling"="none")
        Property Node(instance in=reference to "MV-LoadR1", "Value"="none")
        Property Node(instance in=reference to "PV-LoadR2", "ValueSignaling"="none")
        Property Node(instance in=reference to "PV-Current, mA", "ValueSignaling"=0)
        Property Node(instance in=reference to "MV-LoadR2", "Value"="none")
        Property Node(instance in=reference to "PV-LoadR1", "ValueSignaling"="none")
        Property Node(instance in=reference to "PV-LoadR,Ohm", "ValueSignaling"=0)
        Property Node(instance in=reference to "MV-LoadR3", "Value"="none")
        Property Node(instance in=reference to "PV-LoadRTotal", "ValueSignaling"="none")
        Property Node(instance in=reference to "MV-LoadR4", "Value"="none")
        Property Node(instance in=reference to "MV-LoadRTotal", "Value"="none")
        w351 = default
      }
      frame "Something" {
        # #CodeNeeded - Perform whatever actions correspond to the "Something" message.
        # Send string to "Update Display" message
        call "Enqueue Message (Single).gvi"(message queue in=w345, message="Update Display", message data="\"Do Something\" button pressed", error in=w348) -> (error out=w349)
        w350 = s10
        w351 = default
      }
      frame "Something Else" {
        # #CodeNeeded - Perform whatever actions correspond to the "Something Else" message.
        # Send string to "Update Display" message
        call "Enqueue Message (Single).gvi"(message queue in=w345, message="Update Display", message data="\"Do Something Else\" button pressed", error in=w348) -> (error out=w349)
        w350 = s10
        w351 = default
      }
      frame "Update Display" {
        # #CodeRecommended - If you wish to decouple the Message Handling Loop from your user interface, consider creating User Events (like the "Stop" event in this VI) to message the Event Handling Loop whenever the user interface needs updating.
        Variant To Data(error in (no error)=w348, type=string "", variant=w347) -> (data=w354, error out=w349)
        $"Status of Send to SystemLink Cycle" <- w354
        w350 = s10
        w351 = default
      }
      frame "Error" {
        Variant To Data(error in (no error)=w348, type=no error, variant=w347) -> (data=w355, error out=w349)
        # #CodeRecommended - Consider creating a system for logging errors in some way. These errors are for notification purposes only. Handling of specific errors should be performed in the message frames that generated the error.
        # #CodeRecommended - If you ever change the name of this "Error" message, you'll need to update the name in the Check Loop Error.vi as well.
        call "Display Error.gvi"(error in=w355)
        w350 = s10
        w351 = default
      }
      frame "---Copy This Frame---" {
        Merge Errors(w348) -> (error out=w349)
        w350 = s10
        w351 = default
      }
      frame "Exit" {
        # Release the message queue reference
        Release Queue(error in=w348, queue=w345) -> (error out=w356)
        # #CodeNeeded - Add any required cleanup code here. Note that if 'Exit' was called as a result of an error, an error dialog will be displayed. Add any custom error handling for an 'Exit' condition here as well.
        Generate User Event(event data=TRUE, user event=w341) -> (error out=w357)
        Merge Errors(w357, w356) -> (error out=w349)
        # Stop the VI
        $"Exit 2" <- TRUE
        w350 = s10
        w351 = TRUE
      }
      frame Default {
        w358 = "The invalid message string \"%s\" was received in the Message Handling Loop."
        Format Into String(formatString=w358, w346) -> w359
        call "Build Error Cluster.gvi"(code=1, description=w359) -> (error out=w349)
        w350 = s10
        w351 = default
      }
      frame "Send Double To Cloud" {
        Property Node(instance in=s10, "String"=w346) -> (instance out=w350)
        call "Open Configuration API Key.gvi"(server url=$"Server URL", api key=$"API Key", error in=w348) -> (configuration=w360)
        Variant To Data(type=string[] [], variant=w347) -> (data=w361)
        Array Index(array=w361) -> (out0[0]=w362, out1[1]=w363)
        Floating Point String To Number(string=w363) -> (number=w364)
        Build Array(w362) -> w365
        call "Query Tags.gvi"(paths=w365, configuration=w360) -> (tags=w366, error out=w367)
        Array Index(array=w366) -> (out0[_]=w368)
        Property Node(instance in=w368) -> ("Path"=w369, "Datatype"=w370)
        call "Open Tag.gvi"(path=w369, data type=w370, error in=w367, configuration=w360) -> (tag=w371, error out=w372)
        call "Write Tag (DBL).gvi"(tag in=w371, value=w364, error in=w372) -> (tag out=w373, error out=w374)
        call "Close Tag (Single).gvi"(tag=w373, error in=w374) -> (error out=w375)
        call "Close Configuration.gvi"(configuration=w360, error in=w375) -> (error out=w349)
        call "Enqueue Message (Single).gvi"(message queue in=w345, message="Update Display", message data=w346)
        w351 = default
      }
      frame "Send Measured Data To Cloud" {
        Property Node(instance in=s10, "String"=w346) -> (instance out=w350)
        call "Enqueue Message (Single).gvi"(message queue in=w345, message="Update Display", message data=w346, error in=w348) -> (message queue out=w376, error out=w377)
        call "Enqueue Message (Single).gvi"(message queue in=w376, message=$SendArrayDoubleToCloud, error in=w377) -> (error out=w378)
        call "Open Configuration API Key.gvi"(server url=$"Server URL", api key=$"API Key", error in=w378) -> (configuration=w379, error out=w380)
        w381 = ["PV-Current", "PV-Voltage", "PV-LigthtIntensity", "PV-Temperature"]
        call "Query Tags.gvi"(paths=w381, error in=w380, configuration=w379) -> (tags=w382, error out=w383)
        Property Node(instance in=$"Measured Data") -> ("Voltage, V"=w384, "Current, mA"=w385, "Luminous Flux, Lux"=w386, "Temperature, GradC"=w387)
        Build Array(w384, w385, w386, w387) -> w388
        for {
          w389 = each element of w382
          w390 = each element of w388
          Property Node(instance in=w389) -> ("Path"=w391, "Datatype"=w392)
          call "Open Tag.gvi"(path=w391, data type=w392, error in=w383, configuration=w379) -> (tag=w393, error out=w394)
          call "Write Tag (DBL).gvi"(tag in=w393, value=w390, error in=w394) -> (error out=w395)
        }
        for {
          w396 = each element of w382
          call "Close Tag (Single).gvi"(tag=w396, error in=w395) -> (error out=w397)
        }
        call "Close Configuration.gvi"(configuration=w379, error in=w397) -> (error out=w349)
        w351 = default
      }
      frame "Send String To Cloud" {
        Property Node(instance in=s10, "String"=w346) -> (instance out=w350)
        call "Open Configuration API Key.gvi"(server url=$"Server URL", api key=$"API Key", error in=w348) -> (configuration=w398, error out=w399)
        Variant To Data(type=string[] [], variant=w347) -> (data=w400)
        Array Index(array=w400) -> (out0[0]=w401, out1[1]=w402)
        Build Array(w401) -> w403
        call "Query Tags.gvi"(paths=w403, configuration=w398) -> (tags=w404)
        Array Index(array=w404) -> (out0[_]=w405)
        Property Node(instance in=w405) -> ("Path"=w406, "Datatype"=w407)
        call "Open Tag.gvi"(path=w406, data type=w407, error in=w399, configuration=w398) -> (tag=w408, error out=w409)
        call "Write Tag (String).gvi"(tag in=w408, value=w402, error in=w409) -> (tag out=w410, error out=w411)
        call "Close Tag (Single).gvi"(tag=w410, error in=w411) -> (error out=w412)
        call "Close Configuration.gvi"(configuration=w398, error in=w412) -> (error out=w349)
        call "Enqueue Message (Single).gvi"(message queue in=w345, message="Update Display", message data=w346)
        w351 = default
      }
    }
    call "Error Handler - Message Handling Loop.gvi"(message queue in=w345, error in=w349) -> (dup error in=w413)
    next s10 = w350
    stop if w351
  }
  Register For Events("Stop Event"=w341) -> (event registration refnum out=w414)
  s11 = w414  # shift register
  while {
    event (dynamic events = s11) {
      on "Do Something" Value changed {
        # #CodeNeeded - Send the appropriate message for this user interface event.
        call "Enqueue Message (Single).gvi"(message queue in=w344, message="Something") -> (message queue out=w417, error out=w416)
        w415 = default
      }
      on "Do Something Else" Value changed {
        # #CodeNeeded - Send the appropriate message for this user interface event.
        call "Enqueue Message (Single).gvi"(message queue in=w344, message="Something Else") -> (message queue out=w417, error out=w416)
        w415 = default
      }
      on "Exit" Value changed {
        call "Enqueue Message (Single).gvi"(priority message=TRUE, message queue in=w344, message="Exit") -> (message queue out=w417, error out=w416)
        w415 = default
      }
      on dynamic event 0 {
        # The Message Handling Loop processed an "Exit" message, which fired this event to stop the Event Handling Loop.
        $"Status of Send to SystemLink Cycle" <- "\"Exit\" button pressed"
        w415 = TRUE
        w416 = default
        w417 = w344
      }
      on "Window" Close? {
        call "Enqueue Message (Single).gvi"(priority message=TRUE, message queue in=w344, message="Exit") -> (message queue out=w417)
        Event Filter("Discard?"=TRUE)
        w415 = default
        w416 = default
      }
      on "PV-Current, mA" Value changed {
        Event Data() -> ("New Value"=w418)
        Number To Fractional String(number=w418) -> (F-format string=w419)
        Build Array("PV-Current", w419) -> w420
        call "Enqueue Message (Single).gvi"(message queue in=w344, message=$SendDoubleToCloud, message data=w420) -> (message queue out=w417, error out=w416)
        w415 = default
      }
      on "PV-LoadR,Ohm" Value changed {
        Event Data() -> ("New Value"=w421)
        Number To Fractional String(number=w421) -> (F-format string=w422)
        Build Array("PV-LoadR", w422) -> w423
        call "Enqueue Message (Single).gvi"(message queue in=w344, message=$SendDoubleToCloud, message data=w423) -> (message queue out=w417, error out=w416)
        w415 = default
      }
      on "PV-Voltage, V" Value changed {
        Event Data() -> ("New Value"=w424)
        Number To Fractional String(number=w424) -> (F-format string=w425)
        Build Array("PV-Voltage", w425) -> w426
        call "Enqueue Message (Single).gvi"(message queue in=w344, message=$SendDoubleToCloud, message data=w426) -> (message queue out=w417, error out=w416)
        w415 = default
      }
      on "PV-Temperature, ºC" Value changed {
        Event Data() -> ("New Value"=w427)
        Number To Fractional String(number=w427) -> (F-format string=w428)
        Build Array("PV-Temperature", w428) -> w429
        call "Enqueue Message (Single).gvi"(message queue in=w344, message=$SendDoubleToCloud, message data=w429) -> (message queue out=w417, error out=w416)
        w415 = default
      }
      on "PV-Temperature IR, ºC" Value changed {
        Event Data() -> ("New Value"=w430)
        Number To Fractional String(number=w430) -> (F-format string=w431)
        Build Array("PV-Temperature IR", w431) -> w432
        call "Enqueue Message (Single).gvi"(message queue in=w344, message=$SendDoubleToCloud, message data=w432) -> (message queue out=w417, error out=w416)
        w415 = default
      }
      on "PV-LightIntensity, W/m2" Value changed {
        Event Data() -> ("New Value"=w433)
        Number To Fractional String(number=w433) -> (F-format string=w434)
        Build Array("PV-LigthtIntensity", w434) -> w435
        call "Enqueue Message (Single).gvi"(message queue in=w344, message=$SendDoubleToCloud, message data=w435) -> (message queue out=w417, error out=w416)
        w415 = default
      }
      on "PV-LigthPower, %" Value changed {
        Event Data() -> ("New Value"=w436)
        Number To Fractional String(number=w436) -> (F-format string=w437)
        Build Array("PV-LigthtPower", w437) -> w438
        call "Enqueue Message (Single).gvi"(message queue in=w344, message=$SendDoubleToCloud, message data=w438) -> (message queue out=w417, error out=w416)
        w415 = default
      }
      on "PV-Panel Tilt Angle, º" Value changed {
        Event Data() -> ("New Value"=w439)
        Number To Fractional String(number=w439) -> (F-format string=w440)
        Build Array("PV-Panel Tilt Angle", w440) -> w441
        call "Enqueue Message (Single).gvi"(message queue in=w344, message=$SendDoubleToCloud, message data=w441) -> (message queue out=w417, error out=w416)
        w415 = default
      }
      on "PV-Panel Cofiguration" Value changed {
        Event Data() -> ("New Value"=w442)
        Build Array("PV-Panel Configuration", w442) -> w443
        call "Enqueue Message (Single).gvi"(message queue in=w344, message=$SendStringToCloud, message data=w443) -> (message queue out=w417, error out=w416)
        w415 = default
      }
      on "PV-Temperature IR Position" Value changed {
        Event Data() -> ("New Value"=w444)
        Build Array("PV-Temperature IR Position", w444) -> w445
        call "Enqueue Message (Single).gvi"(message queue in=w344, message=$SendStringToCloud, message data=w445) -> (message queue out=w417, error out=w416)
        w415 = default
      }
      on "PV-Cooling" Value changed {
        Event Data() -> ("New Value"=w446)
        Build Array("PV-Cooling", w446) -> w447
        call "Enqueue Message (Single).gvi"(message queue in=w344, message=$SendStringToCloud, message data=w447) -> (message queue out=w417, error out=w416)
        w415 = default
      }
      on "PV-Heating" Value changed {
        Event Data() -> ("New Value"=w448)
        Build Array("PV-Heating", w448) -> w449
        call "Enqueue Message (Single).gvi"(message queue in=w344, message=$SendStringToCloud, message data=w449) -> (message queue out=w417, error out=w416)
        w415 = default
      }
      on "PV-Optical Filter" Value changed {
        Event Data() -> ("New Value"=w450)
        Build Array("PV-Optical Filter", w450) -> w451
        call "Enqueue Message (Single).gvi"(message queue in=w344, message=$SendStringToCloud, message data=w451) -> (message queue out=w417, error out=w416)
        w415 = default
      }
      on "PV-LoadR1" Value changed {
        Event Data() -> ("New Value"=w452)
        Build Array("PV-LoadR1", w452) -> w453
        call "Enqueue Message (Single).gvi"(message queue in=w344, message=$SendStringToCloud, message data=w453) -> (message queue out=w417)
        w415 = default
        w416 = default
      }
      on "PV-LoadR2" Value changed {
        Event Data() -> ("New Value"=w454)
        Build Array("PV-LoadR2", w454) -> w455
        call "Enqueue Message (Single).gvi"(message queue in=w344, message=$SendStringToCloud, message data=w455) -> (message queue out=w417)
        w415 = default
        w416 = default
      }
      on "PV-LoadR3" Value changed {
        Event Data() -> ("New Value"=w456)
        Build Array("PV-LoadR3", w456) -> w457
        call "Enqueue Message (Single).gvi"(message queue in=w344, message=$SendStringToCloud, message data=w457) -> (message queue out=w417)
        w415 = default
        w416 = default
      }
      on "PV-LoadR4" Value changed {
        Event Data() -> ("New Value"=w458)
        Build Array("PV-LoadR4", w458) -> w459
        call "Enqueue Message (Single).gvi"(message queue in=w344, message=$SendStringToCloud, message data=w459) -> (message queue out=w417)
        w415 = default
        w416 = default
      }
      on "PV-LoadRTotal" Value changed {
        Event Data() -> ("New Value"=w460)
        Build Array("PV-LoadRTotal", w460) -> w461
        call "Enqueue Message (Single).gvi"(message queue in=w344, message=$SendStringToCloud, message data=w461) -> (message queue out=w417)
        w415 = default
        w416 = default
      }
    }
    call "Error Handler - Event Handling Loop.gvi"(message queue in=w417, error in=w416) -> (dup error in=w462)
    stop if w415
  }
  Unregister For Events(error in=w462, event registration refnum=s11) -> (error out=w463)
  Merge Errors(w463, w413) -> (error out=w464)
  Destroy User Event(error in=w464, user event=w341)
  disable {
    frame Enabled { }
    frame Disabled {
      call "Initialize.gvi"(device name="cam0") -> (session out=w465, error out=w466)
      call "Configure Grab.gvi"(session in=w465, error in=w466) -> (session out=w467, error out=w468)
      call "Create Image.gvi"(image name="image_1") -> (new image=w469)
      while {
        call "Grab.gvi"(session in=w467, error in=w468, image in=w469) -> (session out=w470, error out=w471)
        stop if $Stop
      }
      call "Close.gvi"(session=w470, error in=w471)
    }
  }
