vi "Panel Switch.gvi"   [LabVIEW NXG 5.0.0]
inputs:
  "VISA_IN": "VISA Instr"
  "CTRL": string = "Disconnect"
  "ERROR_IN": error
outputs:
  "ERROR_OUT": error
  "VISA_OUT": "VISA Instr"
uses:
  Queued Message Handler::VISA Multiple Write.gvi
diagram:
  $VISA_OUT <- $VISA_IN
  case ($CTRL) {
    frame "Connect" {
      call "VISA Multiple Write.gvi"(VISA_IN=$VISA_IN, ARRAY_IN=["@DO 19 0#", "@DO 22 0#"], ERROR_IN=$ERROR_IN) -> (ERROR_OUT=w1)
    }
    frame "Disconnect", Default {
      call "VISA Multiple Write.gvi"(VISA_IN=$VISA_IN, ARRAY_IN=["@DO 19 1#", "@DO 22 1#"], ERROR_IN=$ERROR_IN) -> (ERROR_OUT=w1)
    }
  }
  $ERROR_OUT <- w1
