vi "VISA WriteRead.gvi"   [LabVIEW NXG 5.0.0]
inputs:
  "VISA_IN": "VISA Instr"
  "CMD": string
  "ERROR_IN": error
outputs:
  "OUTPUT": "VISA Instr"
  "ERROR_OUT": error
  "Arduino_Reply": "ArduinoReply.gtype"
types:
  "ArduinoReply.gtype" = cluster{"Timestamp": timestamp, "DATA": string}
  T1 = cluster{"Element 1": timestamp, "Element 2": string}
uses:
  NI::VISA::Flush Buffer (Instr).gvi
  NI::VISA::Write (Instr, String).gvi
  NI::VISA::Read (Instr, String).gvi
  NI::G Core::Error::Build Error Cluster.gvi
diagram:
  Is Empty String Or Path(string/path=$CMD) -> w1
  case (w1) {
    frame True {
      w2 = T1 {all zero or empty}
      w3 = $ERROR_IN
      w4 = $VISA_IN
    }
    frame False {
      s1 = ""  # shift register
      while (iteration -> i1) {
        Concatenate Strings($CMD, "\r", "\n") -> w5
        Number To Decimal String(number=i1) -> (decimal integer string=w6)
        call "Flush Buffer (Instr).gvi"(session in=$VISA_IN, error in=$ERROR_IN) -> (session out=w7, error out=w8)
        call "Write (Instr, String).gvi"(session in=w7, error in=w8, write buffer=w5) -> (session out=w9, error out=w10)
        sequence {
          frame 0 {
            Wait(time to wait=100)
          }
        }
        call "Read (Instr, String).gvi"(session in=w9, error in=w10, byte count=1000) -> (session out=w4, error out=w11, read buffer=w12)
        Concatenate Strings(s1, " Atempt# ", w6, "---", w5, "---", w12) -> w13
        Match Pattern(regular expression="@OK", string=w12) -> (offset past match=w14)
        Is Greater Or Equal To 0(x=w14) -> w15
        Is Equal(x=5, y=i1) -> w16
        Logical Or(w15, w16) -> w17
        next s1 = w13
        stop if w17
      }
      Get Current Time() -> (current time=w18)
      Build Cluster(w18, w12) -> w2
      case (w15) {
        frame True {
          # No error
          # @OK reply received
          w3 = w11
        }
        frame False {
          w19 = "No \"@OK\" response from Arduino. Log of Command/Respinse: "
          Concatenate Strings(w19, s1) -> w20
          call "Build Error Cluster.gvi"(error in=w11, code=101, description=w20, include call chain=TRUE, make warning=TRUE) -> (error out=w3)
        }
      }
    }
  }
  $OUTPUT <- w4
  $Arduino_Reply <- w2
  $ERROR_OUT <- w3
