vi "SLC.gvi"   [LabVIEW NXG 5.0.0]
panel controls:
  "PV-Temperature, ºC": f64
  "PV-LightIntensity, W/m2": f64
  "PV-Panel Tilt Angle, º": f64
  "error in_2": error
  "PV-Current, mA": f64
  "PV-Voltage, V": f64
  "PV-LoadR,Ohm": f64
  "PV-Panel Cofiguration": string
  "PV-LoadR1": string
  "PV-LoadR2": string
  "PV-LoadR3": string
  "PV-LoadR4": string
  "PV-Cooling": string
  "PV-Heating": string
  "PV-Optical Filter": string
  "Do Something <Replace Me>": bool
  "Do Something Else <Replace Me>": bool
  "Exit": bool
  "Exit 2": bool
panel indicators:
  "error out_2": error
  "MV-Panel Configuration": string
  "MV-Cooling": string
  "MV-Heating": string
  "MV-Optical Filter": string
  "MV-Panel Tilt Angle": string
  "MV-Light Power": string
  "MV-LoadR4": string
  "MV-LoadR3": string
  "MV-LoadR2": string
  "MV-LoadR1": string
  "Display <Replace Me>": string
  "API Key": string
  "Server Url": string
  "SendStringToCloud": string
  "SendDoubleToCloud": string
types:
  "UI Data.gtype" = cluster{"Boolean <Replace Me>": bool, "String <Replace Me>": string, "Numeric <Replace Me>": f64}
uses:
  NI::Skyline::Configuration::Open Configuration API Key.gvi
  NI::Skyline::TagHTTP::Query Tags.gvi
  NI::Skyline::TagHTTP::Open Tag.gvi
  NI::Skyline::TagHTTP::Read Tag (String).gvi
  NI::Skyline::TagHTTP::Close Tag (Single).gvi
  NI::Skyline::Configuration::Close Configuration.gvi
  Message Queue::Create All Message Queues.gvi
  Message Queue::Dequeue Message.gvi
  Message Queue::Enqueue Message (Single).gvi
  NI::G Core::Error::Display Error.gvi
  NI::G Core::Error::Build Error Cluster.gvi
  NI::Skyline::TagHTTP::Write Tag (DBL).gvi
  NI::Skyline::TagHTTP::Write Tag (String).gvi
  Support::Error Handler - Message Handling Loop.gvi
  Support::Error Handler - Event Handling Loop.gvi
diagram:
  $"API Key" <- "zYUbuW0YNkg1G__lXfJiGVBNWME-HlVd2a5NUHp-IP"
  $"Server Url" <- "https://api.systemlinkcloud.com/"
  $SendStringToCloud <- "SendStringToCloud"
  $SendDoubleToCloud <- "SendDoubleToCloud"
  $"MV-Panel Configuration" <- ""
  $"MV-Cooling" <- ""
  $"MV-Heating" <- ""
  $"Exit 2" <- FALSE
  $"MV-Optical Filter" <- ""
  $"MV-Panel Tilt Angle" <- ""
  $"MV-Light Power" <- ""
  $"MV-LoadR1" <- ""
  $"MV-LoadR2" <- ""
  $"MV-LoadR3" <- ""
  $"MV-LoadR4" <- ""
  w1 = ["MV-Panels Configuration", "MV-Cooling", "MV-Heating", "MV-Optical Filter", "MV-Panel Tilt Angle", "MV-Light Power", "MV-LoadR1", "MV-LoadR2", "MV-LoadR3", "MV-LoadR4"]
  Array Size(array=w1) -> (size(s)=w2)
  Initialize Array(element=1904-12-31T23:00:00Z, size=w2) -> w3
  s1 = w3  # shift register
  while {
    Wait(time to wait=500)
    call "Open Configuration API Key.gvi"(server url=$"Server Url", api key=$"API Key", error in=$"error in_2") -> (configuration=w4, error out=w5)
    call "Query Tags.gvi"(paths=w1, error in=w5, configuration=w4) -> (tags=w6, error out=w7)
    Build Array(reference to "MV-Panel Configuration", reference to "MV-Cooling", reference to "MV-Heating", reference to "MV-Optical Filter", reference to "MV-Panel Tilt Angle", reference to "MV-Light Power", reference to "MV-LoadR1", reference to "MV-LoadR2", reference to "MV-LoadR3", reference to "MV-LoadR4") -> w8
    for {
      w9 = each element of w6
      w10 = each element of s1
      w11 = each element of w8
      Property Node(instance in=w9) -> ("Path"=w13, "Datatype"=w14)
      call "Open Tag.gvi"(path=w13, data type=w14, error in=w7, configuration=w4) -> (tag=w15, error out=w16)
      call "Read Tag (String).gvi"(tag in=w15, error in=w16) -> (tag out=w17, value=w18, time stamp=w19, error out=w20)
      Is Greater(x=w19, y=w10) -> w21
      case (w21) {
        frame False, Default { }
        frame True {
          Property Node(instance in=w11, "ValueSignaling"=w18)
        }
      }
      append w19 to w12
    }
    call "Close Tag (Single).gvi"(tag=w17, error in=w20) -> (error out=w22)
    call "Close Configuration.gvi"(configuration=w4, error in=w22) -> (error out=w23)
    $"error out_2" <- w23
    next s1 = w12
    stop if $"Exit 2"
  }
  w24 = bool FALSE  # Stop Event
  Create User Event[EventName="Stop Event"](user event data type=w24) -> (error out=w25, user event out=w26)
  call "Create All Message Queues.gvi"(error in=w25) -> (message queues=w27, error out=w28)
  Property Node(instance in=w27) -> ("UI"=w29)
  s2 = "UI Data.gtype" {all zero or empty}  # shift register
  while {
    call "Dequeue Message.gvi"(message queue in=w29, error in=w28) -> (message queue out=w30, message=w31, message data=w32, error out=w33)
    # s2: Data
    # w26: Stop Event
    case (w31) ignore case {  # Message Cases
      frame "Initialize" {
        Property Node(instance in=s2, "String <Replace Me>"="Initial Message") -> (instance out=w35)
        call "Enqueue Message (Single).gvi"(message queue in=w30, message="Update Display", message data="Initial Message", error in=w33) -> (error out=w34)
        Property Node(instance in=reference to "MV-Panel Configuration", "ValueSignaling"="none")
        # Bundle a sample string value.
        Property Node(instance in=reference to "PV-Panel Cofiguration", "ValueSignaling"="none")
        Property Node(instance in=reference to "PV-Temperature, ºC", "ValueSignaling"=0)
        Property Node(instance in=reference to "MV-Heating", "ValueSignaling"="none")
        Property Node(instance in=reference to "PV-Heating", "ValueSignaling"="none")
        Property Node(instance in=reference to "MV-Cooling", "ValueSignaling"="none")
        Property Node(instance in=reference to "PV-LightIntensity, W/m2", "ValueSignaling"=0)
        Property Node(instance in=reference to "PV-Cooling", "ValueSignaling"="none")
        Property Node(instance in=reference to "MV-Light Power", "ValueSignaling"="none")
        Property Node(instance in=reference to "PV-Panel Tilt Angle, º", "ValueSignaling"=0)
        Property Node(instance in=reference to "PV-Optical Filter", "ValueSignaling"="none")
        Property Node(instance in=reference to "MV-Optical Filter", "ValueSignaling"="none")
        Property Node(instance in=reference to "PV-LoadR4", "ValueSignaling"="none")
        Property Node(instance in=reference to "PV-Voltage, V", "ValueSignaling"=0)
        Property Node(instance in=reference to "MV-Panel Tilt Angle", "ValueSignaling"="none")
        Property Node(instance in=reference to "PV-LoadR3", "ValueSignaling"="none")
        Property Node(instance in=reference to "PV-Current, mA", "ValueSignaling"=0)
        Property Node(instance in=reference to "MV-LoadR1", "ValueSignaling"="none")
        Property Node(instance in=reference to "PV-LoadR2", "ValueSignaling"="none")
        Property Node(instance in=reference to "PV-LoadR,Ohm", "ValueSignaling"=0)
        Property Node(instance in=reference to "MV-LoadR2", "ValueSignaling"="none")
        Property Node(instance in=reference to "PV-LoadR1", "ValueSignaling"="none")
        Property Node(instance in=reference to "MV-LoadR3", "ValueSignaling"="none")
        Property Node(instance in=reference to "MV-LoadR4", "ValueSignaling"="none")
        w36 = default
      }
      frame "Something" {
        # #CodeNeeded - Perform whatever actions correspond to the "Something" message.
        # Send string to "Update Display" message
        call "Enqueue Message (Single).gvi"(message queue in=w30, message="Update Display", message data="\"Do Something\" button pressed", error in=w33) -> (error out=w34)
        w35 = s2
        w36 = default
      }
      frame "Something Else" {
        # #CodeNeeded - Perform whatever actions correspond to the "Something Else" message.
        # Send string to "Update Display" message
        call "Enqueue Message (Single).gvi"(message queue in=w30, message="Update Display", message data="\"Do Something Else\" button pressed", error in=w33) -> (error out=w34)
        w35 = s2
        w36 = default
      }
      frame "Update Display" {
        # #CodeRecommended - If you wish to decouple the Message Handling Loop from your user interface, consider creating User Events (like the "Stop" event in this VI) to message the Event Handling Loop whenever the user interface needs updating.
        Variant To Data(error in (no error)=w33, type=string "", variant=w32) -> (data=w37, error out=w34)
        $"Display <Replace Me>" <- w37
        w35 = s2
        w36 = default
      }
      frame "Error" {
        Variant To Data(error in (no error)=w33, type=no error, variant=w32) -> (data=w38, error out=w34)
        # #CodeRecommended - Consider creating a system for logging errors in some way. These errors are for notification purposes only. Handling of specific errors should be performed in the message frames that generated the error.
        # #CodeRecommended - If you ever change the name of this "Error" message, you'll need to update the name in the Check Loop Error.vi as well.
        call "Display Error.gvi"(error in=w38)
        w35 = s2
        w36 = default
      }
      frame "---Copy This Frame---" {
        Merge Errors(w33) -> (error out=w34)
        w35 = s2
        w36 = default
      }
      frame "Exit" {
        # Release the message queue reference
        Release Queue(error in=w33, queue=w30) -> (error out=w39)
        # #CodeNeeded - Add any required cleanup code here. Note that if 'Exit' was called as a result of an error, an error dialog will be displayed. Add any custom error handling for an 'Exit' condition here as well.
        Generate User Event(event data=TRUE, user event=w26) -> (error out=w40)
        Merge Errors(w40, w39) -> (error out=w34)
        # Stop the VI
        $"Exit 2" <- TRUE
        w35 = s2
        w36 = TRUE
      }
      frame Default {
        w41 = "The invalid message string \"%s\" was received in the Message Handling Loop."
        Format Into String(formatString=w41, w31) -> w42
        call "Build Error Cluster.gvi"(code=1, description=w42) -> (error out=w34)
        w35 = s2
        w36 = default
      }
      frame "SendDoubleToCloud" {
        call "Open Configuration API Key.gvi"(server url=$"Server Url", api key=$"API Key", error in=w33) -> (configuration=w43)
        Variant To Data(type=string[] [], variant=w32) -> (data=w44)
        Array Index(array=w44) -> (out0[0]=w45, out1[1]=w46)
        Floating Point String To Number(string=w46) -> (number=w47)
        Build Array(w45) -> w48
        call "Query Tags.gvi"(paths=w48, configuration=w43) -> (tags=w49, error out=w50)
        Array Index(array=w49) -> (out0[_]=w51)
        Property Node(instance in=w51) -> ("Path"=w52, "Datatype"=w53)
        call "Open Tag.gvi"(path=w52, data type=w53, error in=w50, configuration=w43) -> (tag=w54, error out=w55)
        call "Write Tag (DBL).gvi"(tag in=w54, value=w47, error in=w55) -> (tag out=w56, error out=w57)
        call "Close Tag (Single).gvi"(tag=w56, error in=w57) -> (error out=w58)
        call "Close Configuration.gvi"(configuration=w43, error in=w58) -> (error out=w34)
        w35 = s2
        w36 = default
      }
      frame "SendStringToCloud" {
        call "Open Configuration API Key.gvi"(server url=$"Server Url", api key=$"API Key", error in=w33) -> (configuration=w59, error out=w60)
        Variant To Data(type=string[] [], variant=w32) -> (data=w61)
        Array Index(array=w61) -> (out0[0]=w62, out1[1]=w63)
        Build Array(w62) -> w64
        call "Query Tags.gvi"(paths=w64, configuration=w59) -> (tags=w65)
        Array Index(array=w65) -> (out0[_]=w66)
        Property Node(instance in=w66) -> ("Path"=w67, "Datatype"=w68)
        call "Open Tag.gvi"(path=w67, data type=w68, error in=w60, configuration=w59) -> (tag=w69, error out=w70)
        call "Write Tag (String).gvi"(tag in=w69, value=w63, error in=w70) -> (tag out=w71, error out=w72)
        call "Close Tag (Single).gvi"(tag=w71, error in=w72) -> (error out=w73)
        call "Close Configuration.gvi"(configuration=w59, error in=w73) -> (error out=w34)
        w35 = s2
        w36 = default
      }
    }
    call "Error Handler - Message Handling Loop.gvi"(message queue in=w30, error in=w34) -> (dup error in=w74)
    next s2 = w35
    stop if w36
  }
  Register For Events("Stop Event"=w26) -> (event registration refnum out=w75)
  s3 = w75  # shift register
  while {
    event (dynamic events = s3) {
      on "Do Something <Replace Me>" Value changed {
        # #CodeNeeded - Send the appropriate message for this user interface event.
        call "Enqueue Message (Single).gvi"(message queue in=w29, message="Something") -> (message queue out=w78, error out=w77)
        w76 = default
      }
      on "Do Something Else <Replace Me>" Value changed {
        # #CodeNeeded - Send the appropriate message for this user interface event.
        call "Enqueue Message (Single).gvi"(message queue in=w29, message="Something Else") -> (message queue out=w78, error out=w77)
        w76 = default
      }
      on "Exit" Value changed {
        call "Enqueue Message (Single).gvi"(priority message=TRUE, message queue in=w29, message="Exit") -> (message queue out=w78, error out=w77)
        w76 = default
      }
      on dynamic event 0 {
        # The Message Handling Loop processed an "Exit" message, which fired this event to stop the Event Handling Loop.
        $"Display <Replace Me>" <- "\"Exit\" button pressed"
        w76 = TRUE
        w77 = default
        w78 = w29
      }
      on "Window" Close? {
        call "Enqueue Message (Single).gvi"(priority message=TRUE, message queue in=w29, message="Exit") -> (message queue out=w78)
        Event Filter("Discard?"=TRUE)
        w76 = default
        w77 = default
      }
      on "PV-Current, mA" Value changed {
        Event Data() -> ("New Value"=w79)
        Number To Fractional String(number=w79) -> (F-format string=w80)
        Build Array("PV-Current", w80) -> w81
        call "Enqueue Message (Single).gvi"(message queue in=w29, message=$SendDoubleToCloud, message data=w81) -> (message queue out=w78)
        w76 = default
        w77 = default
      }
      on "PV-LoadR,Ohm" Value changed {
        Event Data() -> ("New Value"=w82)
        Number To Fractional String(number=w82) -> (F-format string=w83)
        Build Array("PV-LoadR", w83) -> w84
        call "Enqueue Message (Single).gvi"(message queue in=w29, message=$SendDoubleToCloud, message data=w84) -> (message queue out=w78)
        w76 = default
        w77 = default
      }
      on "PV-Voltage, V" Value changed {
        Event Data() -> ("New Value"=w85)
        Number To Fractional String(number=w85) -> (F-format string=w86)
        Build Array("PV-Voltage", w86) -> w87
        call "Enqueue Message (Single).gvi"(message queue in=w29, message=$SendDoubleToCloud, message data=w87) -> (message queue out=w78)
        w76 = default
        w77 = default
      }
      on "PV-Temperature, ºC" Value changed {
        Event Data() -> ("New Value"=w88)
        Number To Fractional String(number=w88) -> (F-format string=w89)
        Build Array("PV-Temperature", w89) -> w90
        call "Enqueue Message (Single).gvi"(message queue in=w29, message=$SendDoubleToCloud, message data=w90) -> (message queue out=w78)
        w76 = default
        w77 = default
      }
      on "PV-LightIntensity, W/m2" Value changed {
        Event Data() -> ("New Value"=w91)
        Number To Fractional String(number=w91) -> (F-format string=w92)
        Build Array("PV-LigthtIntensity", w92) -> w93
        call "Enqueue Message (Single).gvi"(message queue in=w29, message=$SendDoubleToCloud, message data=w93) -> (message queue out=w78)
        w76 = default
        w77 = default
      }
      on "PV-Panel Tilt Angle, º" Value changed {
        Event Data() -> ("New Value"=w94)
        Number To Fractional String(number=w94) -> (F-format string=w95)
        Build Array("PV-Panel Tilt Angle", w95) -> w96
        call "Enqueue Message (Single).gvi"(message queue in=w29, message=$SendDoubleToCloud, message data=w96) -> (message queue out=w78)
        w76 = default
        w77 = default
      }
      on "PV-Panel Cofiguration" Value changed {
        Event Data() -> ("New Value"=w97)
        Build Array("PV-Panel Configuration", w97) -> w98
        call "Enqueue Message (Single).gvi"(message queue in=w29, message=$SendStringToCloud, message data=w98) -> (message queue out=w78)
        w76 = default
        w77 = default
      }
      on "PV-Cooling" Value changed {
        Event Data() -> ("New Value"=w99)
        Build Array("PV-Cooling", w99) -> w100
        call "Enqueue Message (Single).gvi"(message queue in=w29, message=$SendStringToCloud, message data=w100) -> (message queue out=w78)
        w76 = default
        w77 = default
      }
      on "PV-Heating" Value changed {
        Event Data() -> ("New Value"=w101)
        Build Array("PV-Heating", w101) -> w102
        call "Enqueue Message (Single).gvi"(message queue in=w29, message=$SendStringToCloud, message data=w102) -> (message queue out=w78)
        w76 = default
        w77 = default
      }
      on "PV-Optical Filter" Value changed {
        Event Data() -> ("New Value"=w103)
        Build Array("PV-Optical Filter", w103) -> w104
        call "Enqueue Message (Single).gvi"(message queue in=w29, message=$SendStringToCloud, message data=w104) -> (message queue out=w78)
        w76 = default
        w77 = default
      }
      on "PV-LoadR1" Value changed {
        Event Data() -> ("New Value"=w105)
        Build Array("PV-LoadR1", w105) -> w106
        call "Enqueue Message (Single).gvi"(message queue in=w29, message=$SendStringToCloud, message data=w106) -> (message queue out=w78)
        w76 = default
        w77 = default
      }
      on "PV-LoadR2" Value changed {
        Event Data() -> ("New Value"=w107)
        Build Array("PV-LoadR2", w107) -> w108
        call "Enqueue Message (Single).gvi"(message queue in=w29, message=$SendStringToCloud, message data=w108) -> (message queue out=w78)
        w76 = default
        w77 = default
      }
      on "PV-LoadR3" Value changed {
        Event Data() -> ("New Value"=w109)
        Build Array("PV-LoadR3", w109) -> w110
        call "Enqueue Message (Single).gvi"(message queue in=w29, message=$SendStringToCloud, message data=w110) -> (message queue out=w78)
        w76 = default
        w77 = default
      }
      on "PV-LoadR4" Value changed {
        Event Data() -> ("New Value"=w111)
        Build Array("PV-LoadR4", w111) -> w112
        call "Enqueue Message (Single).gvi"(message queue in=w29, message=$SendStringToCloud, message data=w112) -> (message queue out=w78)
        w76 = default
        w77 = default
      }
    }
    call "Error Handler - Event Handling Loop.gvi"(message queue in=w78, error in=w77) -> (dup error in=w113)
    stop if w76
  }
  Unregister For Events(error in=w113, event registration refnum=s3) -> (error out=w114)
  Merge Errors(w114, w74) -> (error out=w115)
  Destroy User Event(error in=w115, user event=w26)
