vi "Dequeue Message.gvi"   [LabVIEW NXG 5.0.0]
# This VI pulls messages off the Message Queue.
inputs:
  "message queue in": Queue<"Message Cluster.gtype">, required
  "error in": error
outputs:
  "message queue out": Queue<"Message Cluster.gtype">
  "message": string
  "message data": variant
  "error out": error
types:
  "Message Cluster.gtype" = cluster{"Message": string, "Message Data": variant}
diagram:
  $"message queue out" <- $"message queue in"
  Dequeue Element(queue=$"message queue in") -> (element=w1, error out=w2)
  Property Node(instance in=w1) -> ("Message"=w3, "Message Data"=w4)
  $message <- w3
  $"message data" <- w4
  # This VI pulls messages off the Message Queue. It will dequeue messages regardless of incoming error.
  Merge Errors($"error in", w2) -> (error out=w5)
  $"error out" <- w5
