vi "Function_2.gvi"   [LabVIEW NXG 5.0.0]
inputs:
  "string": string
outputs:
  "Error code": string
  "Reply": f64
diagram:
  Match Pattern(regular expression="@ER", string=$string) -> (after substring=w1, match substring=w2)
  $"Error code" <- w1
  Is Equal(x="@ER", y=w2) -> w3
  Match Pattern(regular expression="@OK REPLY ", string=$string) -> (after substring=w4)
  Floating Point String To Number(string=w4) -> (number=w5)
  Select(s=w3, t=-999, f=w5) -> w6
  $Reply <- w6
