vi "Main.gvi"   [LabVIEW NXG 5.0.0]
# This template is for the Queued Message Handler design pattern.
# The Event Handling Loop generates messages based on user interface actions.
# The Message Handling Loop processes messages generated by the Event Handling Loop, or by other messages.  The messages are string values, so new messages can be added easily to the Message Cases case structure in the Message Handling Loop.  Each message cluster can also provide an optional value for Message Data, which is a variant that can be converted to whatever message-specific data is required.
panel controls:
  "Exit": bool
  "TEMP Button": bool
  "LUX Button": bool
  "VISA Resource Name": "VISA Instr" = "COM5"
  "Initialize VISA": bool
  "CMD Button": bool
  "Initialize AI": bool
  "Panel Config Button": bool
  "Set PV Angle Button": bool
  "IR Thermometer Config Button": bool
  "Fans Button": bool
  "Brightness Config Button": bool
  "Optic Filter Config Button": bool
  "Reset CVM Button": bool
  "Stop": bool
  "PV Config Selector": string
  "PV Angle": i32
  "Fans Selector": string
  "Optic Filter Selector": string
  "IR Thermometer Selector": string
  "Brightness": i32
  "Prepare CVM": bool
  "Command to Arduino": string = "@DO 34 0#"
  "Set LoadR": bool
  "Reset LoadR": bool
  "Total LoadR: R Values separated by coma": string
  "VAC Button": bool
  "Heat Selector": string
  "Heat Button": bool
  "Exit 2": bool
  "Do Something": bool
  "Do Something Else": bool
  "PV-Current, mA": f64
  "PV-LoadR,Ohm": f64
  "PV-Voltage, V": f64
  "PV-Temperature, ºC": f64
  "PV-LightIntensity, W/m2": f64
  "PV-Panel Tilt Angle, º": f64
  "PV-Panel Cofiguration": string
  "PV-Cooling": string
  "PV-Heating": string
  "PV-Optical Filter": string
  "PV-LoadR1": string
  "PV-LoadR2": string
  "PV-LoadR3": string
  "PV-LoadR4": string
  "Tab": i32
  "MeasuredData": f64[]
  "LoadR1": string
  "LoadR10": string
  "LoadR100": string
  "LoadR1000": string
panel indicators:
  "Display": string
  "Command reply": "ArduinoReply.gtype"
  "LUXSensor Reply": "ArduinoReply.gtype"
  "TempSensor Reply": "ArduinoReply.gtype"
  "AI measurements": waveform<f64>[]
  "Hardware Current Status": string
  "Voltage coeff": f64
  "Current coeff": f64
  "Recalculated Voltage": f64
  "Recalculated Current": f64
  "VAC Load Counter": i32
  "Voltage_Graph": f64[]
  "Output": error
  "VISA Answer_2": "ArduinoReply.gtype"[]
  "Current_Graph": f64[]
  "VAC": cluster{"Element 1": f64[], "Element 2": f64[]}
  "PV-Connecting Solar Panels": string
  "CMD TIME": "ArduinoReply.gtype"
  "MV-Panel Configuration": string
  "MV-Cooling": string
  "MV-Heating": string
  "MV-Optical Filter": string
  "MV-Panel Tilt Angle": string
  "MV-Light Power": string
  "MV-LoadR1": string
  "MV-LoadR2": string
  "MV-LoadR3": string
  "MV-LoadR4": string
  "API Key": string
  "Server URL": string
  "Status of Send to SystemLink Cycle": string
  "SendDoubleToCloud": string
  "SendStringToCloud": string
  "Error out Systemlink Read Cycle": error
  "Voltage MidPoint": f64
  "Current MidPoint": f64
  "Arduino Status": string
  "SendArrayDoubleToCloud": string
  "TempSensor": f64
  "LuxSensor": f64
  "LuxSensor Error": string
  "Total Set LoadR": i32
  "TempSensor Error": string
  "MV-LoadRTotal": string
types:
  "ArduinoReply.gtype" = cluster{"Timestamp": timestamp, "DATA": string}
  T1 = cluster{"VISA Resource": "VISA Instr", "Physical Channel": "DAQmx Task"}
  "UI Data.gtype" = cluster{"Boolean": bool, "String": string, "Numeric": f64}
  "ValueRange.gtype" = cluster{"maximum value": f64, "minimum value": f64}
uses:
  NI::Skyline::Configuration::Open Configuration API Key.gvi
  NI::Skyline::TagHTTP::Query Tags.gvi
  NI::Skyline::TagHTTP::Open Tag.gvi
  NI::Skyline::TagHTTP::Read Tag (String).gvi
  NI::Skyline::TagHTTP::Close Tag (Single).gvi
  NI::Skyline::Configuration::Close Configuration.gvi
  Message Queue::Create All Message Queues.gvi
  Message Queue::Enqueue Message (Single).gvi
  Support::Error Handler - Event Handling Loop.gvi
  Message Queue::Dequeue Message.gvi
  NI::VISA::Configure Serial Port (Instr).gvi
  NI::VISA::Open (Instr).gvi
  NI::DAQmx::Internal::DAQmx Create Channel (AI-Voltage-Basic).gvi
  Queued Message Handler::Read_Write_VISA.gvi
  NI::DAQmx::Internal::DAQmx Read (Analog 2D DBL NChan NSamp).gvi
  NI::DAQmx::Internal::DAQmx Read (Analog 1D Wfm NChan NSamp).gvi
  Queued Message Handler::Function_2.gvi
  Queued Message Handler::PV_switch.gvi
  Queued Message Handler::CMD_Iteration.gvi
  NI::G Core::Error::Display Error.gvi
  NI::DAQmx::Internal::DAQmx Stop Task.gvi
  NI::VISA::Close (Instr).gvi
  NI::G Core::Error::Build Error Cluster.gvi
  Support::Error Handler - Message Handling Loop.gvi
  NI::Skyline::TagHTTP::Write Tag (DBL).gvi
  NI::Skyline::TagHTTP::Write Tag (String).gvi
  NI::Vision::IMAQdx::Initialize.gvi
  NI::Vision::IMAQdx::Configure Grab.gvi
  NI::Vision::Core::Basics::Create Image.gvi
  NI::Vision::IMAQdx::Grab.gvi
  NI::Vision::IMAQdx::Close.gvi
diagram:
  $"MV-Panel Configuration" <- ""
  $"MV-Cooling" <- ""
  $"MV-Heating" <- ""
  $"MV-Optical Filter" <- ""
  $"MV-Panel Tilt Angle" <- ""
  $"MV-Light Power" <- ""
  $"MV-LoadR1" <- ""
  $"MV-LoadR2" <- ""
  $"MV-LoadR3" <- ""
  $"MV-LoadR4" <- ""
  $"MV-LoadRTotal" <- ""
  # PV Config
  # 	Single
  # 	Parallel 2
  # 	Parallel 2 Diode
  # 	Series 2
  # 	Series 2 Diode
  # 	Parallel 4
  # 	Parallel 4 Diode
  # 	Series 4
  # 	Series 4 Diode
  # 	Parallel Of Series
  # 	Parallel Of Series Diode
  # 	Series Of Parallel
  # 	Series Of Parallel Diode
  # Optic Filter Config
  # 	No Filter
  # 	Filter 1
  # 	Filter 2
  # IR Thermomether
  # 	None
  # 	Panel 1
  # 	Panel 2
  # 	Panel 3
  # 	Panel 4
  # Heating/Cooling
  # 	0
  # 	50
  # 	100
  # Light Power
  # 	0 ... 100
  # Panel Tilt Angle
  # 	0 ... 120
  # Load 1
  # Load 2
  # Load 3
  # Load 4
  w1 = ["MV-Panels Configuration", "MV-Cooling", "MV-Heating", "MV-Optical Filter", "MV-Panel Tilt Angle", "MV-Light Power", "MV-LoadR1", "MV-LoadR2", "MV-LoadR3", "MV-LoadR4", "MV-LoadRTotal"]
  Array Size(array=w1) -> (size(s)=w2)
  Initialize Array(element=1904-12-31T23:00:00Z, size=w2) -> w3
  sequence {
    frame 0 {
      Wait(time to wait=20000)
    }
  }
  s1 = w3  # shift register
  while {
    Wait(time to wait=500)
    call "Open Configuration API Key.gvi"(server url=$"Server URL", api key=$"API Key") -> (configuration=w4, error out=w5)
    call "Query Tags.gvi"(paths=w1, error in=w5, configuration=w4) -> (tags=w6, error out=w7)
    Build Array(reference to "MV-Panel Configuration", reference to "MV-Cooling", reference to "MV-Heating", reference to "MV-Optical Filter", reference to "MV-Panel Tilt Angle", reference to "MV-Light Power", reference to "MV-LoadR1", reference to "MV-LoadR2", reference to "MV-LoadR3", reference to "MV-LoadR4", reference to "MV-LoadRTotal") -> w8
    for {
      w9 = each element of w6
      w10 = each element of s1
      w11 = each element of w8
      Property Node(instance in=w9) -> ("Path"=w13, "Datatype"=w14)
      call "Open Tag.gvi"(path=w13, data type=w14, error in=w7, configuration=w4) -> (tag=w15, error out=w16)
      call "Read Tag (String).gvi"(tag in=w15, error in=w16) -> (value=w17, time stamp=w18, error out=w19)
      Is Greater(x=w18, y=w10) -> w20
      case (w20) {
        frame False, Default { }
        frame True {
          Property Node(instance in=w11, "ValueSignaling"=w17)
        }
      }
      append w18 to w12
    }
    for {
      w21 = each element of w6
      call "Close Tag (Single).gvi"(tag=w21, error in=w19) -> (error out=w22)
    }
    call "Close Configuration.gvi"(configuration=w4, error in=w22) -> (error out=w23)
    $"Error out Systemlink Read Cycle" <- w23
    next s1 = w12
    stop if $"Exit 2"
  }
  $"PV-Connecting Solar Panels" <- ""
  disable {
    frame Enabled { }
    frame Disabled {
      Destroy User Event()
    }
  }
  w24 = bool FALSE  # Stop Event
  Create User Event[EventName="Stop Event"](user event data type=w24) -> (error out=w25, user event out=w26)
  Register For Events("Stop Event"=w26) -> (event registration refnum out=w27)
  call "Create All Message Queues.gvi"(error in=w25) -> (message queues=w28, error out=w29)
  Property Node(instance in=w28) -> ("UI"=w30)
  # Set Load via MV- x4?
  s2 = w27  # shift register
  while {
    event (dynamic events = s2) {
      on "Exit" Value changed {
        call "Enqueue Message (Single).gvi"(priority message=TRUE, message queue in=w30, message="Exit") -> (message queue out=w33, error out=w32)
        w31 = default
      }
      on dynamic event 0 {
        $Display <- "\"Exit\" button pressed"
        w31 = TRUE
        w32 = default
        w33 = w30
      }
      on "Window" Close? {
        call "Enqueue Message (Single).gvi"(priority message=TRUE, message queue in=w30, message="Exit") -> (message queue out=w33)
        Event Filter("Discard?"=TRUE)
        w31 = default
        w32 = default
      }
      on "Initialize VISA" Value changed {
        call "Enqueue Message (Single).gvi"(message queue in=w30, message="Initialize VISA") -> (message queue out=w33, error out=w32)
        w31 = default
      }
      on "Initialize AI" Value changed {
        call "Enqueue Message (Single).gvi"(message queue in=w30, message="Initialize AI") -> (message queue out=w33, error out=w32)
        w31 = default
      }
      on "CMD Button" Value changed {
        call "Enqueue Message (Single).gvi"(message queue in=w30, message="Send CMD") -> (message queue out=w33, error out=w32)
        w31 = default
      }
      on "TEMP Button" Value changed {
        call "Enqueue Message (Single).gvi"(message queue in=w30, message="Get Temperature") -> (message queue out=w33, error out=w32)
        w31 = default
      }
      on "LUX Button" Value changed {
        call "Enqueue Message (Single).gvi"(message queue in=w30, message="Get Brightness") -> (message queue out=w33, error out=w32)
        w31 = default
      }
      on "Reset CVM Button" Value changed {
        call "Enqueue Message (Single).gvi"(message queue in=w30, message="Reset CVM") -> (message queue out=w33, error out=w32)
        w31 = default
      }
      on "Panel Config Button" Value changed {
        call "Enqueue Message (Single).gvi"(message queue in=w30, message="PV Config", message data=$"PV Config Selector") -> (message queue out=w33, error out=w32)
        w31 = default
      }
      on "MV-Panel Configuration" Value changed {
        Event Data() -> ("New Value"=w34)
        call "Enqueue Message (Single).gvi"(message queue in=w30, message="PV Config", message data=w34) -> (message queue out=w33, error out=w32)
        w31 = default
      }
      on "Heat Button" Value changed {
        call "Enqueue Message (Single).gvi"(message queue in=w30, message="Heat Config", message data=$"Heat Selector") -> (message queue out=w33, error out=w32)
        w31 = default
      }
      on "MV-Heating" Value changed {
        Event Data() -> ("New Value"=w35)
        call "Enqueue Message (Single).gvi"(message queue in=w30, message="Heat Config", message data=w35) -> (message queue out=w33, error out=w32)
        w31 = default
      }
      on "Set PV Angle Button" Value changed {
        call "Enqueue Message (Single).gvi"(message queue in=w30, message="Set PV Angle", message data=$"PV Angle") -> (message queue out=w33, error out=w32)
        w31 = default
      }
      on "MV-Panel Tilt Angle" Value changed {
        Event Data() -> ("New Value"=w36)
        Decimal String To Number(string=w36) -> (offset past number=w37)
        call "Enqueue Message (Single).gvi"(message queue in=w30, message="Set PV Angle", message data=w37) -> (message queue out=w33, error out=w32)
        w31 = default
      }
      on "IR Thermometer Config Button" Value changed {
        call "Enqueue Message (Single).gvi"(message queue in=w30, message="IR Thermometer", message data=$"IR Thermometer Selector") -> (message queue out=w33, error out=w32)
        w31 = default
      }
      on "Fans Button" Value changed {
        call "Enqueue Message (Single).gvi"(message queue in=w30, message="Fans Control", message data=$"Fans Selector") -> (message queue out=w33, error out=w32)
        w31 = default
      }
      on "MV-Cooling" Value changed {
        Event Data() -> ("New Value"=w38)
        call "Enqueue Message (Single).gvi"(message queue in=w30, message="Fans Control", message data=w38) -> (message queue out=w33, error out=w32)
        w31 = default
      }
      on "Brightness Config Button" Value changed {
        call "Enqueue Message (Single).gvi"(message queue in=w30, message="Brightness Config", message data=$Brightness) -> (message queue out=w33, error out=w32)
        w31 = default
      }
      on "MV-Light Power" Value changed {
        Event Data() -> ("New Value"=w39)
        call "Enqueue Message (Single).gvi"(message queue in=w30, message="Brightness Config", message data=w39) -> (message queue out=w33, error out=w32)
        w31 = default
      }
      on "Optic Filter Config Button" Value changed {
        call "Enqueue Message (Single).gvi"(message queue in=w30, message="Optic Filter Config", message data=$"Optic Filter Selector") -> (message queue out=w33, error out=w32)
        w31 = default
      }
      on "MV-Optical Filter" Value changed {
        Event Data() -> ("New Value"=w40)
        call "Enqueue Message (Single).gvi"(message queue in=w30, message="Optic Filter Config", message data=w40) -> (message queue out=w33, error out=w32)
        w31 = default
      }
      on "Prepare CVM" Value changed {
        call "Enqueue Message (Single).gvi"(message queue in=w30, message="Prepare CVM") -> (message queue out=w33, error out=w32)
        w31 = default
      }
      on "Set LoadR" Value changed {
        Concatenate Strings($LoadR1, $LoadR10, $LoadR100, $LoadR1000) -> w41
        call "Enqueue Message (Single).gvi"(message queue in=w30, message="Set LoadR", message data=w41) -> (message queue out=w33, error out=w32)
        w31 = default
      }
      on "MV-LoadRTotal" Value changed {
        Concatenate Strings($LoadR1, $LoadR10, $LoadR100, $LoadR1000) -> w42
        call "Enqueue Message (Single).gvi"(message queue in=w30, message="Set LoadR", message data=w42) -> (message queue out=w33, error out=w32)
        w31 = default
      }
      on "Reset LoadR" Value changed {
        call "Enqueue Message (Single).gvi"(message queue in=w30, message="Reset LoadR") -> (message queue out=w33, error out=w32)
        w31 = default
      }
      on "VAC Button" Value changed {
        Property Node(instance in=reference to "VAC")
        Get Current Time() -> (current time=w43)
        call "Enqueue Message (Single).gvi"(message queue in=w30, message="VAC", message data=w43) -> (message queue out=w33)
        $"VAC Load Counter" <- 0
        w31 = default
        w32 = default
      }
    }
    call "Error Handler - Event Handling Loop.gvi"(message queue in=w33, error in=w32) -> (dup error in=w44)
    stop if w31
  }
  Unregister For Events(error in=w44, event registration refnum=s2)
  $"API Key" <- "zYUbuW0YNkg1G__lXfJiGVBNWME-HlVd2a5NUHp-IP"
  s3 = "UI Data.gtype" {all zero or empty}  # shift register
  s4 = T1 {"VISA Resource"="COM5", "Physical Channel"=""}  # shift register
  while {
    call "Dequeue Message.gvi"(message queue in=w30, error in=w29) -> (message queue out=w45, message=w46, message data=w47, error out=w48)
    $"Hardware Current Status" <- w46
    # s3: Data
    # w26: Stop Event
    case (w46) ignore case {  # Message Cases
      frame "Initialize" {
        call "Enqueue Message (Single).gvi"(message queue in=w45, message="Initialize VISA", error in=w48) -> (message queue out=w53, error out=w54)
        call "Enqueue Message (Single).gvi"(message queue in=w53, message="Initialize AI", error in=w54) -> (message queue out=w55, error out=w56)
        call "Enqueue Message (Single).gvi"(message queue in=w55, message="Set Time", error in=w56) -> (message queue out=w57, error out=w58)
        call "Enqueue Message (Single).gvi"(message queue in=w57, message="Reset CVM", error in=w58) -> (message queue out=w59, error out=w60)
        # set time
        #
        # NO initialase SLC
        call "Enqueue Message (Single).gvi"(message queue in=w59, message="Brightness Config", message data=2, error in=w60) -> (message queue out=w61, error out=w62)
        call "Enqueue Message (Single).gvi"(message queue in=w61, message="Fans Control", message data="0", error in=w62) -> (message queue out=w63, error out=w64)
        call "Enqueue Message (Single).gvi"(message queue in=w63, message="Heat Config", message data="0", error in=w64) -> (message queue out=w65, error out=w66)
        call "Enqueue Message (Single).gvi"(message queue in=w65, message="Optic Filter Config", message data="No Filter", error in=w66) -> (message queue out=w67, error out=w68)
        call "Enqueue Message (Single).gvi"(message queue in=w67, message="IR Thermometer", message data="None", error in=w68) -> (message queue out=w69, error out=w70)
        call "Enqueue Message (Single).gvi"(message queue in=w69, message="Set PV Angle", message data=90, error in=w70) -> (message queue out=w71, error out=w72)
        call "Enqueue Message (Single).gvi"(message queue in=w71, message="PV Config", message data="Parallel 4", error in=w72) -> (message queue out=w73, error out=w74)
        call "Enqueue Message (Single).gvi"(message queue in=w73, message="Wait For Event", error in=w74) -> (error out=w49)
        w50 = s3
        w51 = default
        w52 = s4
      }
      frame "Initialize VISA" {
        call "Configure Serial Port (Instr).gvi"(stop bits="1.0"(10), session in=$"VISA Resource Name", baud rate=115200, parity="None"(0), termination char=0xA, enable termination char=TRUE) -> (session out=w75, error out=w76)
        call "Open (Instr).gvi"(resource name=w75, error in=w76) -> (session out=w77, error out=w78)
        Property Node(instance in=s4, "VISA Resource"=w77) -> (instance out=w52)
        Wait(time to wait=2000)
        Merge Errors(w78, w48) -> (error out=w49)
        w50 = s3
        w51 = default
      }
      frame "Initialize AI" {
        call "DAQmx Create Channel (AI-Voltage-Basic).gvi"(error in=w48, physical channels="Dev1/ai0:1,Dev1/ai3,Dev1/ai7", units="Volts"(10348), measurement range="ValueRange.gtype" {"maximum value"=10, "minimum value"=0}, input terminal configuration="RSE"(10083)) -> (task out=w79, error out=w49)
        Property Node(instance in=s4, "Physical Channel"=w79) -> (instance out=w52)
        w50 = s3
        w51 = default
      }
      frame "Wait For Event" {
        call "Enqueue Message (Single).gvi"(message queue in=w45, message="Watchdog", error in=w48) -> (error out=w49)
        w50 = s3
        w51 = default
        w52 = s4
      }
      frame "Send CMD" {
        Property Node(instance in=s4) -> ("VISA Resource"=w80, instance out=w52)
        call "Enqueue Message (Single).gvi"(message queue in=w45, message="Wait For Event", error in=w48) -> (error out=w81)
        call "Read_Write_VISA.gvi"(VISA_IN=w80, CMD=$"Command to Arduino", ERROR_IN=w81) -> (Arduino_Reply=w82, ERROR_OUT=w49)
        $"Command reply" <- w82
        w50 = s3
        w51 = default
      }
      frame "Set Time" {
        Property Node(instance in=s4) -> ("VISA Resource"=w83, instance out=w52)
        call "Read_Write_VISA.gvi"(VISA_IN=w83, CMD="@TIME 10 CEPHEI#", ERROR_IN=w48) -> (Arduino_Reply=w84, ERROR_OUT=w49)
        $"CMD TIME" <- w84
        w50 = s3
        w51 = default
      }
      frame "Watchdog" {
        Property Node(instance in=s4) -> ("Physical Channel"=w85, "VISA Resource"=w86, instance out=w52)
        call "Read_Write_VISA.gvi"(VISA_IN=w86, CMD="@TIME 10 ?#", ERROR_IN=w48) -> (OUTPUT=w87, Arduino_Reply=w88, ERROR_OUT=w89)
        Property Node(instance in=w88) -> ("DATA"=w90)
        Match Pattern(regular expression="CEPHEI", string=w90) -> (match substring=w91)
        Is Equal(x=w91, y="CEPHEI") -> w92
        case (w92) {
          frame False, Default {
            call "Enqueue Message (Single).gvi"(message queue in=w45, message="Initialize", error in=w89) -> (error out=w49)
          }
          frame True {
            call "Read_Write_VISA.gvi"(VISA_IN=w87, CMD="@LUX 10 1#", ERROR_IN=w89) -> (OUTPUT=w93, Arduino_Reply=w94, ERROR_OUT=w95)
            call "Read_Write_VISA.gvi"(VISA_IN=w93, CMD="@TEMP 8 0#", ERROR_IN=w95) -> (Arduino_Reply=w96, ERROR_OUT=w97)
            call "DAQmx Read (Analog 2D DBL NChan NSamp).gvi"(task in=w85, error in=w97, number of samples per channel=1) -> (error out=w98, data=w99)
            Array Index(array=w99) -> (out0[1, 0]=w100, out1[2, 0]=w101)
            Multiply(w100, 4) -> w102
            Multiply(w102, $"Voltage coeff") -> w103
            Feedback Node(input=w104) -> w105
            Build Array(w105, w103) -> w104
            $Voltage_Graph <- w104
            $"Recalculated Voltage" <- w103
            $"Voltage MidPoint" <- w101
            Array Index(array=w99) -> (out0[0, 0]=w106, out1[3, 0]=w107)
            Divide(x=w106, y=70) -> w108
            Multiply(w108, 1000) -> w109
            Multiply(w109, $"Current coeff") -> w110
            Feedback Node(input=w111) -> w112
            Build Array(w112, w110) -> w111
            $Current_Graph <- w111
            $"Recalculated Current" <- w110
            $"Current MidPoint" <- w107
            call "DAQmx Read (Analog 1D Wfm NChan NSamp).gvi"(task in=w85, error in=w98, number of samples per channel=1) -> (error out=w113, data=w114)
            call "Enqueue Message (Single).gvi"(message queue in=w45, message="Wait For Event", error in=w113) -> (error out=w49)
            Property Node(instance in=reference to "PV-Current, mA", "Value"=w110)
            Property Node(instance in=reference to "PV-Voltage, V", "Value"=w103)
            $"AI measurements" <- w114
            Property Node(instance in=w96) -> ("DATA"=w115, instance out=w116)
            $"TempSensor Reply" <- w116
            call "Function_2.gvi"(string=w115) -> (Error code=w117, Reply=w118)
            $"TempSensor Error" <- w117
            Property Node(instance in=w94) -> ("DATA"=w119, instance out=w120)
            $"LUXSensor Reply" <- w120
            $TempSensor <- w118
            call "Function_2.gvi"(string=w119) -> (Error code=w121, Reply=w122)
            $"LuxSensor Error" <- w121
            $LuxSensor <- w122
            Property Node(instance in=reference to "PV-Temperature, ºC", "Value"=w118)
            Build Array(w103, w110, w118, w122) -> w123
            $MeasuredData <- w123
            Property Node(instance in=reference to "PV-LightIntensity, W/m2", "Value"=w122)
          }
        }
        $"Arduino Status" <- w90
        w50 = s3
        w51 = default
      }
      frame "PV Config" {
        Property Node(instance in=s4) -> ("VISA Resource"=w124, instance out=w52)
        Variant To Data(error in (no error)=w48, type=string "", variant=w47) -> (data=w125, error out=w126)
        call "PV_switch.gvi"(VISA_IN=w124, CTRL="Disconnect", ERROR_IN=w126) -> (VISA_OUT=w127, ERROR_OUT=w128)
        case (w125) {
          frame "Single" {
            w131 = ["@DO 17 0#", "@DO 18 1#", "@DO 23 1#", "@DO 24 1#", "@DO 25 1#", "@DO 26 0#", "@DO 27 0#", "@DO 28 0#", "@DO 29 1#", "@DO 30 1#", "@DO 31 1#", "@DO 32 1#", "@DO 33 0#"]
            w132 = ["@DO 54 1#", "@DO 55 1#", "@DO 56 1#", "@DO 57 1#", "@DO 58 1#", "@DO 59 1#", "@DO 60 1#", "@DO 61 1#"]
            # @DO 17 0#
            # @DO 18 1#
            # @DO 23 1#
            # @DO 24 1#
            # @DO 25 1#
            # @DO 26 0#
            # @DO 27 0#
            # @DO 28 0#
            # @DO 29 1#
            # @DO 30 1#
            # @DO 31 1#
            # @DO 32 1#
            # @DO 33 0#
            #
            # 03,08,2020
            # 19:51
            Insert Into Array(inArray=w131, new=w132) -> w133
            call "CMD_Iteration.gvi"(VISA_IN=w127, ARRAY_IN=w133, ERROR_IN=w128) -> (ERROR_OUT=w129)
            w130 = w125
          }
          frame "Parallel 2" {
            # @DO 17 1#
            # @DO 18 0#
            # @DO 23 1#
            # @DO 24 0#
            # @DO 25 1#
            # @DO 26 1#
            # @DO 27 1#
            # @DO 28 1#
            # @DO 29 1#
            # @DO 30 1#
            # @DO 31 1#
            # @DO 32 1#
            # @DO 33 1#
            #
            # 03.08.2020
            # 19.53
            w134 = ["@DO 17 1#", "@DO 18 0#", "@DO 23 1#", "@DO 24 0#", "@DO 25 1#", "@DO 26 1#", "@DO 27 1#", "@DO 28 1#", "@DO 29 1#", "@DO 30 1#", "@DO 31 1#", "@DO 32 1#", "@DO 33 1#"]
            # Disconnect all Diodes
            w135 = ["@DO 54 1#", "@DO 55 1#", "@DO 56 1#", "@DO 57 1#", "@DO 58 1#", "@DO 59 1#", "@DO 60 1#", "@DO 61 1#"]
            Insert Into Array(inArray=w134, new=w135) -> w136
            call "CMD_Iteration.gvi"(VISA_IN=w127, ARRAY_IN=w136, ERROR_IN=w128) -> (ERROR_OUT=w129)
            w130 = w125
          }
          frame "Parallel 2 Diode" {
            # @DO 17 1#
            # @DO 18 0#
            # @DO 23 1#
            # @DO 24 0#
            # @DO 25 1#
            # @DO 26 1#
            # @DO 27 1#
            # @DO 28 1#
            # @DO 29 1#
            # @DO 30 1#
            # @DO 31 1#
            # @DO 32 1#
            # @DO 33 1#
            #
            # 03.08.2020
            # 19.54
            w137 = ["@DO 17 1#", "@DO 18 0#", "@DO 23 1#", "@DO 24 0#", "@DO 25 1#", "@DO 26 1#", "@DO 27 1#", "@DO 28 1#", "@DO 29 1#", "@DO 30 1#", "@DO 31 1#", "@DO 32 1#", "@DO 33 1#"]
            # @DO 56 0#
            # @DO 57 0#
            #
            # 19.54
            w138 = ["@DO 54 1#", "@DO 55 1#", "@DO 56 0#", "@DO 57 0#", "@DO 58 1#", "@DO 59 1#", "@DO 60 1#", "@DO 61 1#"]
            Insert Into Array(inArray=w137, new=w138) -> w139
            call "CMD_Iteration.gvi"(VISA_IN=w127, ARRAY_IN=w139, ERROR_IN=w128) -> (ERROR_OUT=w129)
            w130 = w125
          }
          frame "Series 2" {
            # @DO 17 0#
            # @DO 18 1#
            # @DO 23 1#
            # @DO 24 0#
            # @DO 25 1#
            # @DO 26 1#
            # @DO 27 1#
            # @DO 28 1#
            # @DO 29 0#
            # @DO 30 1#
            # @DO 31 1#
            # @DO 32 0#
            # @DO 33 0#
            #
            # 03.08.2020
            # 19.55
            w140 = ["@DO 17 0#", "@DO 18 1#", "@DO 23 1#", "@DO 24 0#", "@DO 25 1#", "@DO 26 1#", "@DO 27 1#", "@DO 28 1#", "@DO 29 0#", "@DO 30 1#", "@DO 31 1#", "@DO 32 0#", "@DO 33 0#"]
            w141 = ["@DO 54 1#", "@DO 55 1#", "@DO 56 1#", "@DO 57 1#", "@DO 58 1#", "@DO 59 1#", "@DO 60 1#", "@DO 61 1#"]
            Insert Into Array(inArray=w140, new=w141) -> w142
            call "CMD_Iteration.gvi"(VISA_IN=w127, ARRAY_IN=w142, ERROR_IN=w128) -> (ERROR_OUT=w129)
            w130 = w125
          }
          frame "Series 2 Diode" {
            # @DO 17 0#
            # @DO 18 1#
            # @DO 23 1#
            # @DO 24 0#
            # @DO 25 1#
            # @DO 26 1#
            # @DO 27 1#
            # @DO 28 1#
            # @DO 29 0#
            # @DO 30 1#
            # @DO 31 1#
            # @DO 32 0#
            # @DO 33 0#
            #
            # 03.08.2020
            # 19.57
            w143 = ["@DO 17 0#", "@DO 18 1#", "@DO 23 1#", "@DO 24 0#", "@DO 25 1#", "@DO 26 1#", "@DO 27 1#", "@DO 28 1#", "@DO 29 0#", "@DO 30 1#", "@DO 31 1#", "@DO 32 0#", "@DO 33 0#"]
            # @DO 60 0#
            # @DO 61 0#
            #
            # 03.08.2020
            w144 = ["@DO 54 1#", "@DO 55 1#", "@DO 56 1#", "@DO 57 1#", "@DO 58 1#", "@DO 59 1#", "@DO 60 0#", "@DO 61 0#"]
            Insert Into Array(inArray=w143, new=w144) -> w145
            call "CMD_Iteration.gvi"(VISA_IN=w127, ARRAY_IN=w145, ERROR_IN=w128) -> (ERROR_OUT=w129)
            w130 = w125
          }
          frame "Parallel 4", Default {
            # @DO 17 1#
            # @DO 18 1#
            # @DO 23 1#
            # @DO 24 1#
            # @DO 25 1#
            # @DO 26 1#
            # @DO 27 1#
            # @DO 28 1#
            # @DO 29 1#
            # @DO 30 1#
            # @DO 31 1#
            # @DO 32 1#
            # @DO 33 1#
            #
            # 03.08.2020
            # 19.59
            w146 = ["@DO 17 1#", "@DO 18 1#", "@DO 23 1#", "@DO 24 1#", "@DO 25 1#", "@DO 26 1#", "@DO 27 1#", "@DO 28 1#", "@DO 29 1#", "@DO 30 1#", "@DO 31 1#", "@DO 32 1#", "@DO 33 1#"]
            w147 = ["@DO 54 1#", "@DO 55 1#", "@DO 56 1#", "@DO 57 1#", "@DO 58 1#", "@DO 59 1#", "@DO 60 1#", "@DO 61 1#"]
            Insert Into Array(inArray=w146, new=w147) -> w148
            call "CMD_Iteration.gvi"(VISA_IN=w127, ARRAY_IN=w148, ERROR_IN=w128) -> (ERROR_OUT=w129)
            w130 = "Parallel 4"
          }
          frame "Parallel 4 Diode" {
            # @DO 17 1#
            # @DO 18 1#
            # @DO 23 1#
            # @DO 24 1#
            # @DO 25 1#
            # @DO 26 1#
            # @DO 27 1#
            # @DO 28 1#
            # @DO 29 1#
            # @DO 30 1#
            # @DO 31 1#
            # @DO 32 1#
            # @DO 33 1#
            # 03.08.2020
            # 20.00
            w149 = ["@DO 17 1#", "@DO 18 1#", "@DO 23 1#", "@DO 24 1#", "@DO 25 1#", "@DO 26 1#", "@DO 27 1#", "@DO 28 1#", "@DO 29 1#", "@DO 30 1#", "@DO 31 1#", "@DO 32 1#", "@DO 33 1#"]
            # @DO 54 0#
            # @DO 55 0#
            # @DO 56 0#
            # @DO 57 0#
            #
            # 03.08.2020
            # 20.00
            w150 = ["@DO 54 0#", "@DO 55 0#", "@DO 56 0#", "@DO 57 0#", "@DO 58 1#", "@DO 59 1#", "@DO 60 1#", "@DO 61 1#"]
            Insert Into Array(inArray=w149, new=w150) -> w151
            call "CMD_Iteration.gvi"(VISA_IN=w127, ARRAY_IN=w151, ERROR_IN=w128) -> (ERROR_OUT=w129)
            w130 = w125
          }
          frame "Series 4" {
            # @DO 17 0#
            # @DO 18 1#
            # @DO 23 0#
            # @DO 24 1#
            # @DO 25 1#
            # @DO 26 0#
            # @DO 27 0#
            # @DO 28 0#
            # @DO 29 0#
            # @DO 30 0#
            # @DO 31 0#
            # @DO 32 0#
            # @DO 33 0#
            #
            # 03.08.2020
            # 20.02
            w152 = ["@DO 17 0#", "@DO 18 1#", "@DO 23 0#", "@DO 24 1#", "@DO 25 1#", "@DO 26 0#", "@DO 27 0#", "@DO 28 0#", "@DO 29 0#", "@DO 30 0#", "@DO 31 0#", "@DO 32 0#", "@DO 33 0#"]
            w153 = ["@DO 54 1#", "@DO 55 1#", "@DO 56 1#", "@DO 57 1#", "@DO 58 1#", "@DO 59 1#", "@DO 60 1#", "@DO 61 1#"]
            Insert Into Array(inArray=w152, new=w153) -> w154
            call "CMD_Iteration.gvi"(VISA_IN=w127, ARRAY_IN=w154, ERROR_IN=w128) -> (ERROR_OUT=w129)
            w130 = w125
          }
          frame "Series 4 Diode" {
            # @DO 17 0#
            # @DO 18 1#
            # @DO 23 0#
            # @DO 24 1#
            # @DO 25 1#
            # @DO 26 0#
            # @DO 27 0#
            # @DO 28 0#
            # @DO 29 0#
            # @DO 30 0#
            # @DO 31 0#
            # @DO 32 0#
            # @DO 33 0#
            #
            # 03.08.2020
            # 20.03
            w155 = ["@DO 17 0#", "@DO 18 1#", "@DO 23 0#", "@DO 24 1#", "@DO 25 1#", "@DO 26 0#", "@DO 27 0#", "@DO 28 0#", "@DO 29 0#", "@DO 30 0#", "@DO 31 0#", "@DO 32 0#", "@DO 33 0#"]
            # @DO 58 0#
            # @DO 59 0#
            # @DO 60 0#
            # @DO 61 0#
            #
            # 03.08.2020
            # 20.04
            w156 = ["@DO 54 1#", "@DO 55 1#", "@DO 56 1#", "@DO 57 1#", "@DO 58 0#", "@DO 59 0#", "@DO 60 0#", "@DO 61 0#"]
            Insert Into Array(inArray=w155, new=w156) -> w157
            call "CMD_Iteration.gvi"(VISA_IN=w127, ARRAY_IN=w157, ERROR_IN=w128) -> (ERROR_OUT=w129)
            w130 = w125
          }
          frame "Parallel Of Series" {
            # @DO 17 1#
            # @DO 18 1#
            # @DO 23 1#
            # @DO 24 1#
            # @DO 25 1#
            # @DO 26 1#
            # @DO 27 0#
            # @DO 28 1#
            # @DO 29 0#
            # @DO 30 0#
            # @DO 31 1#
            # @DO 32 0#
            # @DO 33 1#
            #
            # 03.08.2020
            # 20.05
            w158 = ["@DO 17 1#", "@DO 18 1#", "@DO 23 1#", "@DO 24 1#", "@DO 25 1#", "@DO 26 1#", "@DO 27 0#", "@DO 28 1#", "@DO 29 0#", "@DO 30 0#", "@DO 31 1#", "@DO 32 0#", "@DO 33 1#"]
            w159 = ["@DO 54 1#", "@DO 55 1#", "@DO 56 1#", "@DO 57 1#", "@DO 58 1#", "@DO 59 1#", "@DO 60 1#", "@DO 61 1#"]
            Insert Into Array(inArray=w158, new=w159) -> w160
            call "CMD_Iteration.gvi"(VISA_IN=w127, ARRAY_IN=w160, ERROR_IN=w128) -> (ERROR_OUT=w129)
            w130 = w125
          }
          frame "Parallel Of Series Diode" {
            # @DO 17 1#
            # @DO 18 1#
            # @DO 23 1#
            # @DO 24 1#
            # @DO 25 1#
            # @DO 26 1#
            # @DO 27 0#
            # @DO 28 1#
            # @DO 29 0#
            # @DO 30 0#
            # @DO 31 1#
            # @DO 32 0#
            # @DO 33 1#
            #
            # 03.08.2020
            # 20.06
            # @DO 58 0#
            # @DO 59 0#
            # @DO 60 0#
            # @DO 61 0#
            #
            # 03.08.2020
            # 20.097
            w161 = ["@DO 17 1#", "@DO 18 1#", "@DO 23 1#", "@DO 24 1#", "@DO 25 1#", "@DO 26 1#", "@DO 27 0#", "@DO 28 1#", "@DO 29 0#", "@DO 30 0#", "@DO 31 1#", "@DO 32 0#", "@DO 33 1#"]
            w162 = ["@DO 54 1#", "@DO 55 1#", "@DO 56 1#", "@DO 57 1#", "@DO 58 0#", "@DO 59 0#", "@DO 60 0#", "@DO 61 0#"]
            Insert Into Array(inArray=w161, new=w162) -> w163
            call "CMD_Iteration.gvi"(VISA_IN=w127, ARRAY_IN=w163, ERROR_IN=w128) -> (ERROR_OUT=w129)
            w130 = w125
          }
          frame "Series Of Parallel" {
            w164 = ["@DO 54 1#", "@DO 55 1#", "@DO 56 1#", "@DO 57 1#", "@DO 58 1#", "@DO 59 1#", "@DO 60 1#", "@DO 61 1#"]
            # @DO 17 1#
            # @DO 18 0#
            # @DO 23 0#
            # @DO 24 0#
            # @DO 25 0#
            # @DO 26 1#
            # @DO 27 1#
            # @DO 28 1#
            # @DO 29 1#
            # @DO 30 1#
            # @DO 31 1#
            # @DO 32 1#
            # @DO 33 1#
            #
            # 03.08.2020
            # 20.07
            w165 = ["@DO 17 1#", "@DO 18 0#", "@DO 23 0#", "@DO 24 0#", "@DO 25 0#", "@DO 26 1#", "@DO 27 1#", "@DO 28 1#", "@DO 29 1#", "@DO 30 1#", "@DO 31 1#", "@DO 32 1#", "@DO 33 1#"]
            Insert Into Array(inArray=w165, new=w164) -> w166
            call "CMD_Iteration.gvi"(VISA_IN=w127, ARRAY_IN=w166, ERROR_IN=w128) -> (ERROR_OUT=w129)
            w130 = w125
          }
          frame "Series Of Parallel Diode" {
            # @DO 17 1#
            # @DO 18 0#
            # @DO 23 0#
            # @DO 24 0#
            # @DO 25 0#
            # @DO 26 1#
            # @DO 27 1#
            # @DO 28 1#
            # @DO 29 1#
            # @DO 30 1#
            # @DO 31 1#
            # @DO 32 1#
            # @DO 33 1#
            #
            # 03.08.2020
            # 20.08
            w167 = ["@DO 17 1#", "@DO 18 0#", "@DO 23 0#", "@DO 24 0#", "@DO 25 0#", "@DO 26 1#", "@DO 27 1#", "@DO 28 1#", "@DO 29 1#", "@DO 30 1#", "@DO 31 1#", "@DO 32 1#", "@DO 33 1#"]
            # @DO 54 0#
            # @DO 55 0#
            # @DO 56 0#
            # @DO 57 0#
            #
            # 20.09
            # 03.08.2020
            w168 = ["@DO 54 0#", "@DO 55 0#", "@DO 56 0#", "@DO 57 0#", "@DO 58 1#", "@DO 59 1#", "@DO 60 1#", "@DO 61 1#"]
            Insert Into Array(inArray=w167, new=w168) -> w169
            call "CMD_Iteration.gvi"(VISA_IN=w127, ARRAY_IN=w169, ERROR_IN=w128) -> (ERROR_OUT=w129)
            w130 = w125
          }
        }
        call "PV_switch.gvi"(VISA_IN=w124, CTRL="Connect", ERROR_IN=w129) -> (ERROR_OUT=w49)
        Property Node(instance in=reference to "PV-Panel Cofiguration", "ValueSignaling"=w130)
        w50 = s3
        w51 = default
      }
      frame "Prepare CVM" {
        Property Node(instance in=s4) -> ("VISA Resource"=w170, "Physical Channel"=w171, instance out=w52)
        call "DAQmx Read (Analog 2D DBL NChan NSamp).gvi"(task in=w171, error in=w48, number of samples per channel=1) -> (error out=w172, data=w173)
        Array Index(array=w173) -> (out0[2, 0]=w174)
        Multiply(w174, 4) -> w175
        C Code Node("x"=w175, Error In=w172) -> ("y"=w176, Error Out=w177)
        ~~~
        if(x>-1 && x<=1)
          y = 0;
        if(x>1 && x<=10)
          y = 1;
        if(x>10 && x<=20)
          y = 2;
        if(x>20 && x<=30)
          y = 3;
        ~~~
        Array Index(array=w173) -> (out0[3, 0]=w178)
        # Tip For Local Wiring Solution
        # Relay 1(50) 	DO 1- REP A x1
        # 		DO 0- AMP A x10
        #
        # Relay 2(51) 	DO 1-REP V x1
        # 		DO 0-DIV V x0.25
        # Relay 3(52) 	DO 1-REP V x1
        # 		DO 0-DIV V x0.5
        # Relay 4(53) 	DO 1-REP V x1
        # 		DO 0-AMP V x10
        C Code Node("x"=w178, Error In=w177) -> ("y"=w179, Error Out=w180)
        ~~~
        if(x>-1 && x<=0.6)
          y = 0;
        if(x>0.6 && x<=6)
          y = 1;
        ~~~
        # Voltage Range
        case (w176) {
          frame 0, Default {
            call "CMD_Iteration.gvi"(VISA_IN=w170, ARRAY_IN=["@DO 51 1#", "@DO 52 1#", "@DO 53 0#"], ERROR_IN=w180) -> (VISA Answer=w183, ERROR_OUT=w181)
            w182 = 0.1
          }
          frame 1 {
            call "CMD_Iteration.gvi"(VISA_IN=w170, ARRAY_IN=["@DO 51 1#", "@DO 52 1#", "@DO 53 1#"], ERROR_IN=w180) -> (VISA Answer=w183, ERROR_OUT=w181)
            w182 = 1
          }
          frame 2 {
            call "CMD_Iteration.gvi"(VISA_IN=w170, ARRAY_IN=["@DO 51 1#", "@DO 52 0#", "@DO 53 1#"], ERROR_IN=w180) -> (VISA Answer=w183, ERROR_OUT=w181)
            w182 = 0.5
          }
          frame 3 {
            # Div x0.25 works with 2 relay
            call "CMD_Iteration.gvi"(VISA_IN=w170, ARRAY_IN=["@DO 51 0#\n"], ERROR_IN=w180) -> (VISA Answer=w183, ERROR_OUT=w181)
            w182 = 0.25
          }
        }
        $"Voltage coeff" <- w182
        $"VISA Answer_2" <- w183
        # Current Range
        case (w179) {
          frame 0, Default {
            call "CMD_Iteration.gvi"(VISA_IN=w170, ARRAY_IN=["@DO 50 0#"], ERROR_IN=w181) -> (ERROR_OUT=w49)
            w184 = 0.1
          }
          frame 1 {
            call "CMD_Iteration.gvi"(VISA_IN=w170, ARRAY_IN=["@DO 50 1#"], ERROR_IN=w181) -> (ERROR_OUT=w49)
            w184 = 1
          }
        }
        $"Current coeff" <- w184
        w50 = s3
        w51 = default
      }
      frame "Reset CVM" {
        Property Node(instance in=s4) -> ("VISA Resource"=w185, instance out=w52)
        # VOLTAGE RANGE
        # @DO 51 0#
        # @DO 52 0#
        # @DO 53 0#
        # CURRENT RANGE
        # @DO 50 1#
        call "CMD_Iteration.gvi"(VISA_IN=w185, ARRAY_IN=["@DO 51 1#", "@DO 52 1#", "@DO 53 1#"], ERROR_IN=w48) -> (VISA_OUT=w186, ERROR_OUT=w187)
        call "CMD_Iteration.gvi"(VISA_IN=w186, ARRAY_IN=["@DO 50 1#"], ERROR_IN=w187) -> (ERROR_OUT=w49)
        $"Voltage coeff" <- 1
        $"Current coeff" <- 1
        w50 = s3
        w51 = default
      }
      frame "VAC" {
        w188 = ["0", "1,", "10,", "20,10,", "50,", "50,20,", "100,", "100,40,10,", "200,100,", "500,100,", "1000,", "2000,", "2000,1000,", "4000,", "4000,1000,", "4000,2000,", "4000,2000,1000,", "4000,2000,1000,500,400,100,"]
        Array Size(array=w188) -> (size(s)=w189)
        Is Less Or Equal(x=$"VAC Load Counter", y=w189) -> w190
        Property Node(instance in=s4) -> ("VISA Resource"=w191, "Physical Channel"=w192, instance out=w52)
        Variant To Data(type=timestamp 1904-01-01T00:00:00Z, variant=w47) -> (data=w193)
        Get Current Time() -> (current time=w194)
        Timestamp Subtract(x=w194, y=w193) -> w195
        Is Greater Or Equal(x=w195, y=5) -> w196
        Logical And(w196, w190) -> w197
        call "DAQmx Read (Analog 2D DBL NChan NSamp).gvi"(task in=w192, number of samples per channel=1) -> (data=w198)
        Array Index(array=w198) -> (out0[1, 0]=w199)
        Multiply(w199, 4) -> w200
        Feedback Node(input=w201) -> w202
        Build Array(w202, w200) -> w201
        Array Index(array=w198) -> (out0[0, 0]=w203)
        Divide(x=w203, y=70) -> w204
        Multiply(w204, 1000) -> w205
        Feedback Node(input=w206) -> w207
        Build Array(w207, w205) -> w206
        Build Cluster(w201, w206) -> w208
        case (w197) {
          frame False, Default {
            w209 = w48
            w210 = w193
            w211 = $"VAC Load Counter"
          }
          frame True {
            Get Current Time() -> (current time=w210)
            # Disconnect ALL load
            Array Index(array=w188) -> (out0[$"VAC Load Counter"]=w212)
            w213 = ["@DO 42 1#", "@DO 34 0#", "@DO 35 0#", "@DO 36 0#", "@DO 37 0#", "@DO 38 0#", "@DO 39 0#", "@DO 40 0#", "@DO 41 0#", "@DO 43 0#", "@DO 44 0#", "@DO 45 0#", "@DO 46 0#", "@DO 47 0#", "@DO 48 0#", "@DO 49 0#"]
            call "CMD_Iteration.gvi"(VISA_IN=w191, ARRAY_IN=w213, ERROR_IN=w48) -> (ERROR_OUT=w214)
            s5 = w212  # shift register
            while {
              Match Pattern(regular expression=",", string=s5) -> (after substring=w215, before substring=w216)
              case (w216) {
                frame "1", Default {
                  call "Read_Write_VISA.gvi"(VISA_IN=w191, CMD="@DO 43 1#", ERROR_IN=w214) -> (ERROR_OUT=w217)
                }
                frame "2" {
                  call "Read_Write_VISA.gvi"(VISA_IN=w191, CMD="@DO 44 1#", ERROR_IN=w214) -> (ERROR_OUT=w217)
                }
                frame "3" {
                  call "Read_Write_VISA.gvi"(VISA_IN=w191, CMD="@DO 45 1#", ERROR_IN=w214) -> (ERROR_OUT=w217)
                }
                frame "5" {
                  call "Read_Write_VISA.gvi"(VISA_IN=w191, CMD="@DO 46 1#", ERROR_IN=w214) -> (ERROR_OUT=w217)
                }
                frame "10" {
                  call "Read_Write_VISA.gvi"(VISA_IN=w191, CMD="@DO 47 1#", ERROR_IN=w214) -> (ERROR_OUT=w217)
                }
                frame "20" {
                  call "Read_Write_VISA.gvi"(VISA_IN=w191, CMD="@DO 48 1#", ERROR_IN=w214) -> (ERROR_OUT=w217)
                }
                frame "40" {
                  call "Read_Write_VISA.gvi"(VISA_IN=w191, CMD="@DO 49 1#", ERROR_IN=w214) -> (ERROR_OUT=w217)
                }
                frame "50" {
                  call "Read_Write_VISA.gvi"(VISA_IN=w191, CMD="@DO 34 1#", ERROR_IN=w214) -> (ERROR_OUT=w217)
                }
                frame "100" {
                  call "Read_Write_VISA.gvi"(VISA_IN=w191, CMD="@DO 35 1#", ERROR_IN=w214) -> (ERROR_OUT=w217)
                }
                frame "200" {
                  call "Read_Write_VISA.gvi"(VISA_IN=w191, CMD="@DO 36 1#", ERROR_IN=w214) -> (ERROR_OUT=w217)
                }
                frame "400" {
                  call "Read_Write_VISA.gvi"(VISA_IN=w191, CMD="@DO 37 1#", ERROR_IN=w214) -> (ERROR_OUT=w217)
                }
                frame "500" {
                  call "Read_Write_VISA.gvi"(VISA_IN=w191, CMD="@DO 38 1#", ERROR_IN=w214) -> (ERROR_OUT=w217)
                }
                frame "1000" {
                  call "Read_Write_VISA.gvi"(VISA_IN=w191, CMD="@DO 39 1#", ERROR_IN=w214) -> (ERROR_OUT=w217)
                }
                frame "2000" {
                  call "Read_Write_VISA.gvi"(VISA_IN=w191, CMD="@DO 40 1#", ERROR_IN=w214) -> (ERROR_OUT=w217)
                }
                frame "4000" {
                  call "Read_Write_VISA.gvi"(VISA_IN=w191, CMD="@DO 41 1#", ERROR_IN=w214) -> (ERROR_OUT=w217)
                }
                frame "0" {
                  # Для измерения тока К.З.
                  # Схема сопротивления
                  # 1 Ом + 1 Ом токовый резистор
                  w217 = w214
                }
              }
              Is Empty String Or Path(string/path=w215) -> w218
              next s5 = w215
              stop if w218
            }
            call "Read_Write_VISA.gvi"(VISA_IN=w191, CMD="@DO 42 0#", ERROR_IN=w217) -> (ERROR_OUT=w209)
            Increment(x=$"VAC Load Counter") -> w211
            $VAC <- w208
          }
        }
        call "Enqueue Message (Single).gvi"(message queue in=w45, message="Watchdog", error in=w209) -> (error out=w219)
        case (w190) {
          frame False, Default {
            call "Enqueue Message (Single).gvi"(message queue in=w45, message="Reset LoadR", error in=w219) -> (error out=w49)
          }
          frame True {
            call "Enqueue Message (Single).gvi"(message queue in=w45, message="VAC", message data=w210, error in=w219) -> (error out=w49)
          }
        }
        $"VAC Load Counter" <- w211
        w50 = s3
        w51 = default
      }
      frame "Optic Filter Config" {
        Variant To Data(error in (no error)=w48, type=string "", variant=w47) -> (data=w220, error out=w221)
        case (w220) {
          frame "No Filter", Default {
            w222 = ["@SERV 3 90#", "@SERV 4 0#"]
            w223 = "No Filter"
          }
          frame "Filter 1" {
            w222 = ["@SERV 3 90#", "@SERV 4 0#", "@SERV 3 0#"]
            w223 = w220
          }
          frame "Filter 2" {
            w222 = ["@SERV 3 90#", "@SERV 4 0#", "@SERV 4 90#"]
            w223 = w220
          }
        }
        Property Node(instance in=reference to "PV-Optical Filter", "ValueSignaling"=w223)
        Property Node(instance in=s4) -> ("VISA Resource"=w224, instance out=w52)
        call "CMD_Iteration.gvi"(VISA_IN=w224, ARRAY_IN=w222, ERROR_IN=w221) -> (ERROR_OUT=w49)
        w50 = s3
        w51 = default
      }
      frame "Fans Control" {
        Variant To Data(error in (no error)=w48, type=string "", variant=w47) -> (data=w225, error out=w226)
        case (w225) {
          frame "0", Default {
            w227 = ["@DO 11 0#", "@DO 12 0#"]
            w228 = "0"
          }
          frame "100" {
            w227 = ["@PWM 11 255#", "@PWM 12 255#"]
            w228 = "100"
          }
          frame "50" {
            w227 = ["@PWM 11 127#", "@PWM 12 127#"]
            w228 = "50"
          }
        }
        Property Node(instance in=reference to "PV-Cooling", "ValueSignaling"=w228)
        Property Node(instance in=s4) -> ("VISA Resource"=w229, instance out=w52)
        call "CMD_Iteration.gvi"(VISA_IN=w229, ARRAY_IN=w227, ERROR_IN=w226) -> (ERROR_OUT=w49)
        w50 = s3
        w51 = default
      }
      frame "Heat Config" {
        Variant To Data(error in (no error)=w48, type=string "", variant=w47) -> (data=w230, error out=w231)
        case (w230) {
          frame "0", Default {
            w232 = ["@DO 9 0#"]
            w233 = "0"
          }
          frame "50" {
            w232 = ["@PWM 9 125#"]
            w233 = "50"
          }
          frame "100" {
            w232 = ["@PWM 9 255#"]
            w233 = "100"
          }
        }
        Property Node(instance in=reference to "PV-Heating", "ValueSignaling"=w233)
        Property Node(instance in=s4) -> ("VISA Resource"=w234, instance out=w52)
        call "CMD_Iteration.gvi"(VISA_IN=w234, ARRAY_IN=w232, ERROR_IN=w231) -> (ERROR_OUT=w49)
        w50 = s3
        w51 = default
      }
      frame "Set PV Angle" {
        Variant To Data(error in (no error)=w48, type=u32 0, variant=w47) -> (data=w235, error out=w236)
        # Set angle limits for PV panels
        In Range And Coerce(lower limit=0, upper limit=180, x=w235) -> (coerced(x)=w237)
        Property Node(instance in=reference to "PV-Panel Tilt Angle, º", "ValueSignaling"=w237)
        Property Node(instance in=s4) -> ("VISA Resource"=w238, instance out=w52)
        Number To Decimal String(number=w237) -> (decimal integer string=w239)
        Concatenate Strings("@SERV 13 ", w239, "#") -> w240
        call "Read_Write_VISA.gvi"(VISA_IN=w238, CMD=w240, ERROR_IN=w236) -> (ERROR_OUT=w49)
        w50 = s3
        w51 = default
      }
      frame "Brightness Config" {
        Property Node(instance in=s4) -> ("VISA Resource"=w241, instance out=w52)
        Variant To Data(error in (no error)=w48, type=u32 0, variant=w47) -> (data=w242, error out=w243)
        # Set brightness limits
        In Range And Coerce(lower limit=0, upper limit=100, x=w242) -> (coerced(x)=w244)
        Number To Decimal String(number=w244) -> (decimal integer string=w245)
        Concatenate Strings("@DIM 6 ", w245, "#") -> w246
        call "Read_Write_VISA.gvi"(VISA_IN=w241, CMD=w246, ERROR_IN=w243) -> (ERROR_OUT=w49)
        w50 = s3
        w51 = default
      }
      frame "IR Thermometer" {
        Property Node(instance in=s4) -> ("VISA Resource"=w247, instance out=w52)
        Variant To Data(error in (no error)=w48, type=string "", variant=w47) -> (data=w248, error out=w249)
        case (w248) {
          frame "None", Default {
            w250 = "@SERV 5 0#"
          }
          frame "Panel 1" {
            w250 = "@SERV 5 50#"
          }
          frame "Panel 2" {
            w250 = "@SERV 5 75#"
          }
          frame "Panel 3" {
            w250 = "@SERV 5 110#"
          }
          frame "Panel 4" {
            w250 = "@SERV 5 130#"
          }
        }
        call "Read_Write_VISA.gvi"(VISA_IN=w247, CMD=w250, ERROR_IN=w249) -> (ERROR_OUT=w49)
        w50 = s3
        w51 = default
      }
      frame "Set LoadR" {
        Variant To Data(error in (no error)=w48, type=string "", variant=w47) -> (data=w251, error out=w252)
        Property Node(instance in=s4) -> ("VISA Resource"=w253, instance out=w52)
        # Disconnect ALL load
        w254 = ["@DO 42 1#", "@DO 34 0#", "@DO 35 0#", "@DO 36 0#", "@DO 37 0#", "@DO 38 0#", "@DO 39 0#", "@DO 40 0#", "@DO 41 0#", "@DO 43 0#", "@DO 44 0#", "@DO 45 0#", "@DO 46 0#", "@DO 47 0#", "@DO 48 0#", "@DO 49 0#"]
        sequence {
          frame 0 {
            call "CMD_Iteration.gvi"(VISA_IN=w253, ARRAY_IN=w254, ERROR_IN=w252) -> (VISA_OUT=w255, ERROR_OUT=w256)
            $"Total Set LoadR" <- 1
          }
        }
        s6 = w251  # shift register
        s7 = 0  # shift register
        while {
          Match Pattern(regular expression=";", string=s6) -> (after substring=w257, before substring=w258)
          s8 = w258  # shift register
          s9 = s7  # shift register
          while {
            Match Pattern(regular expression=",", string=s8) -> (after substring=w259, before substring=w260)
            case (w260) {
              frame "1" {
                call "Read_Write_VISA.gvi"(VISA_IN=w255, CMD="@DO 43 1#", ERROR_IN=w256) -> (ERROR_OUT=w261)
              }
              frame "2" {
                call "Read_Write_VISA.gvi"(VISA_IN=w255, CMD="@DO 44 1#", ERROR_IN=w256) -> (ERROR_OUT=w261)
              }
              frame "3" {
                call "Read_Write_VISA.gvi"(VISA_IN=w255, CMD="@DO 45 1#", ERROR_IN=w256) -> (ERROR_OUT=w261)
              }
              frame "5" {
                call "Read_Write_VISA.gvi"(VISA_IN=w255, CMD="@DO 46 1#", ERROR_IN=w256) -> (ERROR_OUT=w261)
              }
              frame "10" {
                call "Read_Write_VISA.gvi"(VISA_IN=w255, CMD="@DO 47 1#", ERROR_IN=w256) -> (ERROR_OUT=w261)
              }
              frame "20" {
                call "Read_Write_VISA.gvi"(VISA_IN=w255, CMD="@DO 48 1#", ERROR_IN=w256) -> (ERROR_OUT=w261)
              }
              frame "40" {
                call "Read_Write_VISA.gvi"(VISA_IN=w255, CMD="@DO 49 1#", ERROR_IN=w256) -> (ERROR_OUT=w261)
              }
              frame "50" {
                call "Read_Write_VISA.gvi"(VISA_IN=w255, CMD="@DO 34 1#", ERROR_IN=w256) -> (ERROR_OUT=w261)
              }
              frame "100" {
                call "Read_Write_VISA.gvi"(VISA_IN=w255, CMD="@DO 35 1#", ERROR_IN=w256) -> (ERROR_OUT=w261)
              }
              frame "200" {
                call "Read_Write_VISA.gvi"(VISA_IN=w255, CMD="@DO 36 1#", ERROR_IN=w256) -> (ERROR_OUT=w261)
              }
              frame "400" {
                call "Read_Write_VISA.gvi"(VISA_IN=w255, CMD="@DO 37 1#", ERROR_IN=w256) -> (ERROR_OUT=w261)
              }
              frame "500" {
                call "Read_Write_VISA.gvi"(VISA_IN=w255, CMD="@DO 38 1#", ERROR_IN=w256) -> (ERROR_OUT=w261)
              }
              frame "1000" {
                call "Read_Write_VISA.gvi"(VISA_IN=w255, CMD="@DO 39 1#", ERROR_IN=w256) -> (ERROR_OUT=w261)
              }
              frame "2000" {
                call "Read_Write_VISA.gvi"(VISA_IN=w255, CMD="@DO 40 1#", ERROR_IN=w256) -> (ERROR_OUT=w261)
              }
              frame "4000" {
                call "Read_Write_VISA.gvi"(VISA_IN=w255, CMD="@DO 41 1#", ERROR_IN=w256) -> (ERROR_OUT=w261)
              }
              frame "0", Default {
                # Для измерения тока К.З.
                # Схема сопротивления
                # 1 Ом + 1 Ом токовый резистор
                w261 = w256
              }
            }
            Decimal String To Number(string=w260) -> (number=w262)
            Add(w262, s9) -> w263
            $"Total Set LoadR" <- w263
            Is Empty String Or Path(string/path=w259) -> w264
            next s8 = w259
            next s9 = w263
            stop if w264
          }
          Is Empty String Or Path(string/path=w257) -> w265
          next s6 = w257
          next s7 = s9
          stop if w265
        }
        Property Node(instance in=reference to "PV-LoadR,Ohm", "ValueSignaling"=s7)
        # Connect Load
        call "Read_Write_VISA.gvi"(VISA_IN=w253, CMD="@DO 42 0#", ERROR_IN=w261) -> (ERROR_OUT=w49)
        $"Total Set LoadR" <- s7
        w50 = s3
        w51 = default
      }
      frame "NoLoad" {
        # Сопротивление в начальное положение
        Property Node(instance in=reference to "PV-LoadR,Ohm", "ValueSignaling"=-1)
        Property Node(instance in=s4) -> ("VISA Resource"=w266, instance out=w52)
        # Размыкаются всё реле, сопротивление- бесконечность
        w267 = ["@DO 42 1#", "@DO 34 1#", "@DO 35 1#", "@DO 36 1#", "@DO 37 1#", "@DO 38 1#", "@DO 39 1#", "@DO 40 1#", "@DO 41 1#", "@DO 43 1#", "@DO 44 1#", "@DO 45 1#", "@DO 46 1#", "@DO 47 1#", "@DO 48 1#", "@DO 49 1#"]
        call "CMD_Iteration.gvi"(VISA_IN=w266, ARRAY_IN=w267, ERROR_IN=w48) -> (ERROR_OUT=w49)
        $"Total Set LoadR" <- -1
        w50 = s3
        w51 = default
      }
      frame "Error" {
        Variant To Data(error in (no error)=w48, type=no error, variant=w47) -> (data=w268, error out=w49)
        # #CodeRecommended - If you ever change the name of this "Error" message, you'll need to update the name in the Check Loop Error.vi as well.
        call "Display Error.gvi"(error in=w268)
        w50 = s3
        w51 = default
        w52 = s4
      }
      frame "Exit" {
        Generate User Event(event data=TRUE, user event=w26) -> (error out=w269)
        Release Queue(error in=w48, queue=w45) -> (error out=w270)
        Property Node(instance in=s4) -> ("VISA Resource"=w271, "Physical Channel"=w272)
        call "DAQmx Stop Task.gvi"(task in=w272) -> (error out=w273)
        call "Close (Instr).gvi"(session in=w271, error in=w273) -> (error out=w274)
        Merge Errors(w274, w269, w270) -> (error out=w49)
        w50 = s3
        w51 = TRUE
        w52 = default
      }
      frame Default {
        w275 = "The invalid message string \"%s\" was received in the Message Handling Loop."
        Format Into String(formatString=w275, w46) -> w276
        call "Build Error Cluster.gvi"(code=1, description=w276) -> (error out=w49)
        w50 = s3
        w51 = default
        w52 = s4
      }
    }
    call "Error Handler - Message Handling Loop.gvi"(message queue in=w45, error in=w49) -> (dup error in=w277)
    $Output <- w49
    next s3 = w50
    next s4 = w52
    stop if w51
  }
  $"Server URL" <- "https://api.systemlinkcloud.com/"
  $"Exit 2" <- FALSE
  $SendArrayDoubleToCloud <- "Send Measured Data To Cloud"
  $SendStringToCloud <- "Send String To Cloud"
  $SendDoubleToCloud <- "Send Double To Cloud"
  w278 = bool FALSE  # Stop Event
  Create User Event[EventName="Stop Event"](user event data type=w278) -> (error out=w279, user event out=w280)
  call "Create All Message Queues.gvi"(error in=w279) -> (message queues=w281, error out=w282)
  Property Node(instance in=w281) -> ("UI"=w283)
  s10 = "UI Data.gtype" {all zero or empty}  # shift register
  while {
    call "Dequeue Message.gvi"(message queue in=w283, error in=w282) -> (message queue out=w284, message=w285, message data=w286, error out=w287)
    # s10: Data
    # w280: Stop Event
    case (w285) ignore case {  # Message Cases
      frame "Initialize" {
        Property Node(instance in=s10, "String"=w285) -> (instance out=w289)
        call "Enqueue Message (Single).gvi"(message queue in=w284, message="Update Display", message data=w285, error in=w287) -> (message queue out=w291, error out=w292)
        # Bundle a sample string value.
        call "Enqueue Message (Single).gvi"(message queue in=w291, message=$SendArrayDoubleToCloud, error in=w292) -> (error out=w288)
        Property Node(instance in=reference to "MV-Panel Configuration", "ValueSignaling"="none")
        Property Node(instance in=reference to "PV-Panel Cofiguration", "ValueSignaling"="none")
        Property Node(instance in=reference to "PV-Temperature, ºC", "ValueSignaling"=0)
        Property Node(instance in=reference to "MV-Heating", "ValueSignaling"="none")
        Property Node(instance in=reference to "PV-Heating", "ValueSignaling"="none")
        Property Node(instance in=reference to "MV-Cooling", "ValueSignaling"="none")
        Property Node(instance in=reference to "PV-LightIntensity, W/m2", "ValueSignaling"=0)
        Property Node(instance in=reference to "PV-Cooling", "ValueSignaling"="none")
        Property Node(instance in=reference to "MV-Light Power", "ValueSignaling"="none")
        Property Node(instance in=reference to "PV-Panel Tilt Angle, º", "ValueSignaling"=0)
        Property Node(instance in=reference to "PV-Optical Filter", "ValueSignaling"="none")
        Property Node(instance in=reference to "MV-Optical Filter", "ValueSignaling"="none")
        Property Node(instance in=reference to "PV-LoadR4", "ValueSignaling"="none")
        Property Node(instance in=reference to "PV-Voltage, V", "ValueSignaling"=0)
        Property Node(instance in=reference to "MV-Panel Tilt Angle", "ValueSignaling"="none")
        Property Node(instance in=reference to "PV-LoadR3", "ValueSignaling"="none")
        Property Node(instance in=reference to "PV-Current, mA", "ValueSignaling"=0)
        Property Node(instance in=reference to "MV-LoadR1", "ValueSignaling"="none")
        Property Node(instance in=reference to "PV-LoadR2", "ValueSignaling"="none")
        Property Node(instance in=reference to "PV-LoadR,Ohm", "ValueSignaling"=0)
        Property Node(instance in=reference to "MV-LoadR2", "ValueSignaling"="none")
        Property Node(instance in=reference to "PV-LoadR1", "ValueSignaling"="none")
        Property Node(instance in=reference to "MV-LoadR3", "ValueSignaling"="none")
        Property Node(instance in=reference to "MV-LoadR4", "ValueSignaling"="none")
        w290 = default
      }
      frame "Something" {
        # #CodeNeeded - Perform whatever actions correspond to the "Something" message.
        # Send string to "Update Display" message
        call "Enqueue Message (Single).gvi"(message queue in=w284, message="Update Display", message data="\"Do Something\" button pressed", error in=w287) -> (error out=w288)
        w289 = s10
        w290 = default
      }
      frame "Something Else" {
        # #CodeNeeded - Perform whatever actions correspond to the "Something Else" message.
        # Send string to "Update Display" message
        call "Enqueue Message (Single).gvi"(message queue in=w284, message="Update Display", message data="\"Do Something Else\" button pressed", error in=w287) -> (error out=w288)
        w289 = s10
        w290 = default
      }
      frame "Update Display" {
        # #CodeRecommended - If you wish to decouple the Message Handling Loop from your user interface, consider creating User Events (like the "Stop" event in this VI) to message the Event Handling Loop whenever the user interface needs updating.
        Variant To Data(error in (no error)=w287, type=string "", variant=w286) -> (data=w293, error out=w288)
        $"Status of Send to SystemLink Cycle" <- w293
        w289 = s10
        w290 = default
      }
      frame "Error" {
        Variant To Data(error in (no error)=w287, type=no error, variant=w286) -> (data=w294, error out=w288)
        # #CodeRecommended - Consider creating a system for logging errors in some way. These errors are for notification purposes only. Handling of specific errors should be performed in the message frames that generated the error.
        # #CodeRecommended - If you ever change the name of this "Error" message, you'll need to update the name in the Check Loop Error.vi as well.
        call "Display Error.gvi"(error in=w294)
        w289 = s10
        w290 = default
      }
      frame "---Copy This Frame---" {
        Merge Errors(w287) -> (error out=w288)
        w289 = s10
        w290 = default
      }
      frame "Exit" {
        # Release the message queue reference
        Release Queue(error in=w287, queue=w284) -> (error out=w295)
        # #CodeNeeded - Add any required cleanup code here. Note that if 'Exit' was called as a result of an error, an error dialog will be displayed. Add any custom error handling for an 'Exit' condition here as well.
        Generate User Event(event data=TRUE, user event=w280) -> (error out=w296)
        Merge Errors(w296, w295) -> (error out=w288)
        # Stop the VI
        $"Exit 2" <- TRUE
        w289 = s10
        w290 = TRUE
      }
      frame Default {
        w297 = "The invalid message string \"%s\" was received in the Message Handling Loop."
        Format Into String(formatString=w297, w285) -> w298
        call "Build Error Cluster.gvi"(code=1, description=w298) -> (error out=w288)
        w289 = s10
        w290 = default
      }
      frame "Send Double To Cloud" {
        Property Node(instance in=s10, "String"=w285) -> (instance out=w289)
        call "Open Configuration API Key.gvi"(server url=$"Server URL", api key=$"API Key", error in=w287) -> (configuration=w299)
        Variant To Data(type=string[] [], variant=w286) -> (data=w300)
        Array Index(array=w300) -> (out0[0]=w301, out1[1]=w302)
        Floating Point String To Number(string=w302) -> (number=w303)
        Build Array(w301) -> w304
        call "Query Tags.gvi"(paths=w304, configuration=w299) -> (tags=w305, error out=w306)
        Array Index(array=w305) -> (out0[_]=w307)
        Property Node(instance in=w307) -> ("Path"=w308, "Datatype"=w309)
        call "Open Tag.gvi"(path=w308, data type=w309, error in=w306, configuration=w299) -> (tag=w310, error out=w311)
        call "Write Tag (DBL).gvi"(tag in=w310, value=w303, error in=w311) -> (tag out=w312, error out=w313)
        call "Close Tag (Single).gvi"(tag=w312, error in=w313) -> (error out=w314)
        call "Close Configuration.gvi"(configuration=w299, error in=w314) -> (error out=w288)
        call "Enqueue Message (Single).gvi"(message queue in=w284, message="Update Display", message data=w285)
        w290 = default
      }
      frame "Send Measured Data To Cloud" {
        Property Node(instance in=s10, "String"=w285) -> (instance out=w289)
        call "Enqueue Message (Single).gvi"(message queue in=w284, message="Update Display", message data=w285, error in=w287) -> (message queue out=w315, error out=w316)
        call "Enqueue Message (Single).gvi"(message queue in=w315, message=$SendArrayDoubleToCloud, error in=w316) -> (error out=w317)
        call "Open Configuration API Key.gvi"(server url=$"Server URL", api key=$"API Key", error in=w317) -> (configuration=w318, error out=w319)
        w320 = ["PV-Current", "PV-Voltage", "PV-Temperature", "PV-LigthtIntensity"]
        call "Query Tags.gvi"(paths=w320, error in=w319, configuration=w318) -> (tags=w321, error out=w322)
        for {
          w323 = each element of w321
          w324 = each element of $MeasuredData
          Property Node(instance in=w323) -> ("Path"=w325, "Datatype"=w326)
          call "Open Tag.gvi"(path=w325, data type=w326, error in=w322, configuration=w318) -> (tag=w327, error out=w328)
          call "Write Tag (DBL).gvi"(tag in=w327, value=w324, error in=w328) -> (error out=w329)
        }
        for {
          w330 = each element of w321
          call "Close Tag (Single).gvi"(tag=w330, error in=w329) -> (error out=w331)
        }
        call "Close Configuration.gvi"(configuration=w318, error in=w331) -> (error out=w288)
        w290 = default
      }
      frame "Send String To Cloud" {
        Property Node(instance in=s10, "String"=w285) -> (instance out=w289)
        call "Open Configuration API Key.gvi"(server url=$"Server URL", api key=$"API Key", error in=w287) -> (configuration=w332, error out=w333)
        Variant To Data(type=string[] [], variant=w286) -> (data=w334)
        Array Index(array=w334) -> (out0[0]=w335, out1[1]=w336)
        Build Array(w335) -> w337
        call "Query Tags.gvi"(paths=w337, configuration=w332) -> (tags=w338)
        Array Index(array=w338) -> (out0[_]=w339)
        Property Node(instance in=w339) -> ("Path"=w340, "Datatype"=w341)
        call "Open Tag.gvi"(path=w340, data type=w341, error in=w333, configuration=w332) -> (tag=w342, error out=w343)
        call "Write Tag (String).gvi"(tag in=w342, value=w336, error in=w343) -> (tag out=w344, error out=w345)
        call "Close Tag (Single).gvi"(tag=w344, error in=w345) -> (error out=w346)
        call "Close Configuration.gvi"(configuration=w332, error in=w346) -> (error out=w288)
        call "Enqueue Message (Single).gvi"(message queue in=w284, message="Update Display", message data=w285)
        w290 = default
      }
    }
    call "Error Handler - Message Handling Loop.gvi"(message queue in=w284, error in=w288) -> (dup error in=w347)
    next s10 = w289
    stop if w290
  }
  Register For Events("Stop Event"=w280) -> (event registration refnum out=w348)
  s11 = w348  # shift register
  while {
    event (dynamic events = s11) {
      on "Do Something" Value changed {
        # #CodeNeeded - Send the appropriate message for this user interface event.
        call "Enqueue Message (Single).gvi"(message queue in=w283, message="Something") -> (message queue out=w351, error out=w350)
        w349 = default
      }
      on "Do Something Else" Value changed {
        # #CodeNeeded - Send the appropriate message for this user interface event.
        call "Enqueue Message (Single).gvi"(message queue in=w283, message="Something Else") -> (message queue out=w351, error out=w350)
        w349 = default
      }
      on "Exit" Value changed {
        call "Enqueue Message (Single).gvi"(priority message=TRUE, message queue in=w283, message="Exit") -> (message queue out=w351, error out=w350)
        w349 = default
      }
      on dynamic event 0 {
        # The Message Handling Loop processed an "Exit" message, which fired this event to stop the Event Handling Loop.
        $"Status of Send to SystemLink Cycle" <- "\"Exit\" button pressed"
        w349 = TRUE
        w350 = default
        w351 = w283
      }
      on "Window" Close? {
        call "Enqueue Message (Single).gvi"(priority message=TRUE, message queue in=w283, message="Exit") -> (message queue out=w351)
        Event Filter("Discard?"=TRUE)
        w349 = default
        w350 = default
      }
      on "PV-Current, mA" Value changed {
        Event Data() -> ("New Value"=w352)
        Number To Fractional String(number=w352) -> (F-format string=w353)
        Build Array("PV-Current", w353) -> w354
        call "Enqueue Message (Single).gvi"(message queue in=w283, message=$SendDoubleToCloud, message data=w354) -> (message queue out=w351)
        w349 = default
        w350 = default
      }
      on "PV-LoadR,Ohm" Value changed {
        Event Data() -> ("New Value"=w355)
        Number To Fractional String(number=w355) -> (F-format string=w356)
        Build Array("PV-LoadR", w356) -> w357
        call "Enqueue Message (Single).gvi"(message queue in=w283, message=$SendDoubleToCloud, message data=w357) -> (message queue out=w351)
        w349 = default
        w350 = default
      }
      on "PV-Voltage, V" Value changed {
        Event Data() -> ("New Value"=w358)
        Number To Fractional String(number=w358) -> (F-format string=w359)
        Build Array("PV-Voltage", w359) -> w360
        call "Enqueue Message (Single).gvi"(message queue in=w283, message=$SendDoubleToCloud, message data=w360) -> (message queue out=w351)
        w349 = default
        w350 = default
      }
      on "PV-Temperature, ºC" Value changed {
        Event Data() -> ("New Value"=w361)
        Number To Fractional String(number=w361) -> (F-format string=w362)
        Build Array("PV-Temperature", w362) -> w363
        call "Enqueue Message (Single).gvi"(message queue in=w283, message=$SendDoubleToCloud, message data=w363) -> (message queue out=w351)
        w349 = default
        w350 = default
      }
      on "PV-LightIntensity, W/m2" Value changed {
        Event Data() -> ("New Value"=w364)
        Number To Fractional String(number=w364) -> (F-format string=w365)
        Build Array("PV-LigthtIntensity", w365) -> w366
        call "Enqueue Message (Single).gvi"(message queue in=w283, message=$SendDoubleToCloud, message data=w366) -> (message queue out=w351)
        w349 = default
        w350 = default
      }
      on "PV-Panel Tilt Angle, º" Value changed {
        Event Data() -> ("New Value"=w367)
        Number To Fractional String(number=w367) -> (F-format string=w368)
        Build Array("PV-Panel Tilt Angle", w368) -> w369
        call "Enqueue Message (Single).gvi"(message queue in=w283, message=$SendDoubleToCloud, message data=w369) -> (message queue out=w351)
        w349 = default
        w350 = default
      }
      on "PV-Panel Cofiguration" Value changed {
        Event Data() -> ("New Value"=w370)
        Build Array("PV-Panel Configuration", w370) -> w371
        call "Enqueue Message (Single).gvi"(message queue in=w283, message=$SendStringToCloud, message data=w371) -> (message queue out=w351)
        w349 = default
        w350 = default
      }
      on "PV-Cooling" Value changed {
        Event Data() -> ("New Value"=w372)
        Build Array("PV-Cooling", w372) -> w373
        call "Enqueue Message (Single).gvi"(message queue in=w283, message=$SendStringToCloud, message data=w373) -> (message queue out=w351)
        w349 = default
        w350 = default
      }
      on "PV-Heating" Value changed {
        Event Data() -> ("New Value"=w374)
        Build Array("PV-Heating", w374) -> w375
        call "Enqueue Message (Single).gvi"(message queue in=w283, message=$SendStringToCloud, message data=w375) -> (message queue out=w351)
        w349 = default
        w350 = default
      }
      on "PV-Optical Filter" Value changed {
        Event Data() -> ("New Value"=w376)
        Build Array("PV-Optical Filter", w376) -> w377
        call "Enqueue Message (Single).gvi"(message queue in=w283, message=$SendStringToCloud, message data=w377) -> (message queue out=w351)
        w349 = default
        w350 = default
      }
      on "PV-LoadR1" Value changed {
        Event Data() -> ("New Value"=w378)
        Build Array("PV-LoadR1", w378) -> w379
        call "Enqueue Message (Single).gvi"(message queue in=w283, message=$SendStringToCloud, message data=w379) -> (message queue out=w351)
        w349 = default
        w350 = default
      }
      on "PV-LoadR2" Value changed {
        Event Data() -> ("New Value"=w380)
        Build Array("PV-LoadR2", w380) -> w381
        call "Enqueue Message (Single).gvi"(message queue in=w283, message=$SendStringToCloud, message data=w381) -> (message queue out=w351)
        w349 = default
        w350 = default
      }
      on "PV-LoadR3" Value changed {
        Event Data() -> ("New Value"=w382)
        Build Array("PV-LoadR3", w382) -> w383
        call "Enqueue Message (Single).gvi"(message queue in=w283, message=$SendStringToCloud, message data=w383) -> (message queue out=w351)
        w349 = default
        w350 = default
      }
      on "PV-LoadR4" Value changed {
        Event Data() -> ("New Value"=w384)
        Build Array("PV-LoadR4", w384) -> w385
        call "Enqueue Message (Single).gvi"(message queue in=w283, message=$SendStringToCloud, message data=w385) -> (message queue out=w351)
        w349 = default
        w350 = default
      }
    }
    call "Error Handler - Event Handling Loop.gvi"(message queue in=w351, error in=w350) -> (dup error in=w386)
    stop if w349
  }
  Unregister For Events(error in=w386, event registration refnum=s11) -> (error out=w387)
  Merge Errors(w387, w347) -> (error out=w388)
  Destroy User Event(error in=w388, user event=w280)
  disable {
    frame Enabled { }
    frame Disabled {
      call "Initialize.gvi"(device name="cam0") -> (session out=w389, error out=w390)
      call "Configure Grab.gvi"(session in=w389, error in=w390) -> (session out=w391, error out=w392)
      call "Create Image.gvi"(image name="image_1") -> (new image=w393)
      while {
        call "Grab.gvi"(session in=w391, error in=w392, image in=w393) -> (session out=w394, error out=w395)
        stop if $Stop
      }
      call "Close.gvi"(session=w394, error in=w395)
    }
  }
