vi "Read_Write_VISA.gvi"   [LabVIEW NXG 5.0.0]
inputs:
  "VISA_IN": "VISA Instr"
  "CMD": string
  "ERROR_IN": error
outputs:
  "OUTPUT": "VISA Instr"
  "ERROR_OUT": error
  "Arduino_Reply": "ArduinoReply.gtype"
types:
  "ArduinoReply.gtype" = cluster{"Timestamp": timestamp, "DATA": string}
uses:
  NI::VISA::Flush Buffer (Instr).gvi
  NI::VISA::Write (Instr, String).gvi
  NI::VISA::Read (Instr, String).gvi
diagram:
  call "Flush Buffer (Instr).gvi"(session in=$VISA_IN, error in=$ERROR_IN) -> (session out=w1, error out=w2)
  Concatenate Strings($CMD, "\r", "\n") -> w3
  call "Write (Instr, String).gvi"(session in=w1, error in=w2, write buffer=w3) -> (session out=w4, error out=w5)
  sequence {
    frame 0 {
      Wait(time to wait=100)
    }
  }
  call "Read (Instr, String).gvi"(session in=w4, error in=w5, byte count=1000) -> (session out=w6, error out=w7, read buffer=w8)
  $OUTPUT <- w6
  Get Current Time() -> (current time=w9)
  Build Cluster(w9, w8) -> w10
  $Arduino_Reply <- w10
  $ERROR_OUT <- w7
