vi "Send S To Server.gvi"   [LabVIEW NXG 5.0.0]
inputs:
  "Time Stamp": timestamp
  "Path": string
  "Data Type": "DataType.gtype" = "Double"
  "API Key": string = "zYUbuW0YNkg1G__lXfJiGVBNWME-HlVd2a5NUHp-IP"
  "Server Url": string = "https://api.systemlinkcloud.com/"
  "Value": string
  "Error In": error
outputs:
  "Error Out": error
types:
  "DataType.gtype" = enum{"Double", "I32", "String", "Boolean", "U64", "Timestamp"}
uses:
  NI::Skyline::Configuration::Open Configuration API Key.gvi
  NI::Skyline::TagHTTP::Open Tag.gvi
  NI::Skyline::TagHTTP::Write Tag (String).gvi
  NI::Skyline::TagHTTP::Close Tag (Single).gvi
  NI::Skyline::Configuration::Close Configuration.gvi
diagram:
  call "Open Configuration API Key.gvi"(server url=$"Server Url", api key=$"API Key", error in=$"Error In") -> (configuration=w1, error out=w2)
  call "Open Tag.gvi"(path=$Path, data type=$"Data Type", error in=w2, configuration=w1) -> (tag=w3, error out=w4)
  call "Write Tag (String).gvi"(tag in=w3, value=$Value, time stamp=$"Time Stamp", error in=w4) -> (tag out=w5, error out=w6)
  call "Close Tag (Single).gvi"(tag=w5, error in=w6) -> (error out=w7)
  call "Close Configuration.gvi"(configuration=w1, error in=w7) -> (error out=w8)
  $"Error Out" <- w8
