vi "Test COM Port.gvi"   [LabVIEW NXG 5.0.0]
panel controls:
  "session in": "VISA Instr"
uses:
  NI::VISA::Configure Serial Port (Instr).gvi
  NI::VISA::Open (Instr).gvi
diagram:
  call "Configure Serial Port (Instr).gvi"(session in=$"session in", baud rate=115200) -> (session out=w1, error out=w2)
  call "Open (Instr).gvi"(resource name=w1, error in=w2)
